# Grasshopper definition FTK-GH-ArchicadTranslatorPublic.gh (Grasshopper 1.0.7)
# plug-ins: treesloth01, Grasshopper-ARCHICAD Live Connection 2.2, Telepathy, HFTidyCanvas

data = Data(Tree({0;0;0;10;1;3;2;0;0;0}: [Line((-10529.99996, 2657.526876, 3800), (-10529.99996, 885.0268757, 3800))], {0;0;0;10;1;3;2;0;1;0}: [Line((-10577.49996, 2657.526876, 3900), (-10577.49996, -8429.973124, 3900))], {0;0;0;10;1;3;2;0;1;1}: [Line((-10529.99996, -1614.973124, 3800), (-10529.99996, -2814.973124, 3800))], {0;0;0;10;1;3;2;0;2;0}: [Line((-10529.99996, -3414.973124, 3800), (-10529.99996, -4614.973124, 3800))], {0;0;0;10;1;3;2;0;3;0}: [Line((-10529.99996, -6414.973124, 3800), (-10529.99996, -7614.973124, 3800))], {0;0;0;10;1;3;2;0;4;0}: [Line((-10577.49996, 2885.026876, 3800), (-10577.49996, 2685.026876, 3800))]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))
data_2 = Data(data)

# ----
# Select option / Run
selectoption = ValueList({"One": 0, "Two": 1, "Three": 2, "Four": 3, "Five": 4}, selected="Three")
run = BooleanToggle(False)
rungeneration = RemoteSender(run)
facadeversion = RemoteSender(selectoption)

facadeversion_2 = RemoteReceiver(facadeversion)
# Input data
concat = Concatenate(FragmentA="{", FragmentB=facadeversion_2, FragmentC=";*}")
split = SplitTree(Data=data_2, Masks=flatten(concat))  # -> Positive, Negative
selectedversion = Data(split.Positive)
split_2 = SplitTree(Data=split.Positive, Masks=flatten("{?;8;*}"))  # -> Positive, Negative
dataforselectedversion = RemoteSender(selectedversion)
facadetype = RemoteSender(split_2.Positive)
# Replace text with Archicad elements
layer = Layer(AC_Layer=(2, 0, -1))
layer_2 = Layer(AC_Layer=(2, 0, -1))
layer_3 = Layer(AC_Layer=(2, 0, -1))
dataforselectedversion_2 = RemoteReceiver(dataforselectedversion)
comp = Composite(AC_Composite=(2, 0, -1))
comp_2 = Composite(AC_Composite=(2, 0, -1))
comp_3 = Composite(AC_Composite=(2, 0, -1))
comp_4 = Composite(AC_Composite=(2, 0, -1))
comp_5 = Composite(AC_Composite=(2, 0, -1))
comp_6 = Composite(AC_Composite=(2, 0, -1))
dataforselectedversion_3 = RemoteReceiver(dataforselectedversion)
story = StoryPlane(AC_Story0_AC_Story=(3, 0, -1))
story_2 = StoryPlane(AC_Story0_AC_Story=(3, 0, -1))
story_3 = StoryPlane(AC_Story0_AC_Story=(3, 0, -1))
story_4 = StoryPlane(AC_Story0_AC_Story=(3, 0, -1))
story_5 = StoryPlane(AC_Story0_AC_Story=(3, 0, -1))
story_6 = StoryPlane(AC_Story0_AC_Story=(3, 0, -1))
story_7 = StoryPlane(AC_Story0_AC_Story=(3, 0, -1))
story_8 = StoryPlane(AC_Story0_AC_Story=(3, 0, -1))
story_9 = StoryPlane(AC_Story0_AC_Story=(3, 0, -1))
dataforselectedversion_4 = RemoteReceiver(dataforselectedversion)
profile = Profile(AC_Profile=(4, 0, -1))
dataforselectedversion_5 = RemoteReceiver(dataforselectedversion)
buildmat = BuildingMaterial(AC_BuildingMaterial=(2, 0, -1))
dataforselectedversion_6 = RemoteReceiver(dataforselectedversion)
merge = Merge(Data1=layer, Data2=layer_2, Data3=layer_3)
split_3 = SplitTree(
    Data=dataforselectedversion_2,
    Masks=flatten(["{?;0;5;*}", "{?;1;4;*}", "{?;2;3;*}", "{?;3;1;*}", "{?;5;2;*}", "{?;6;3;*}"]))  # -> Positive, Negative
merge_2 = Merge(Data1=comp, Data2=comp_2, Data3=comp_3, Data4=comp_4, Data5=comp_5, Data6=comp_6)
split_4 = SplitTree(Data=dataforselectedversion_3, Masks=flatten(["{?;0;1;*}", "{?;1;1;*}"]))  # -> Positive, Negative
merge_3 = Merge(
    Data3=story,
    Data4=story_2,
    Data5=story_3,
    Data6=story_4,
    Data7=story_5,
    Data8=story_6,
    Data9=story_7,
    Data10=story_8,
    Data11=story_9)
split_5 = SplitTree(Data=dataforselectedversion_4, Masks=flatten(["{?;0;3;*}", "{?;1;3;*}", "{?;2;1;*}"]))  # -> Positive, Negative
split_6 = SplitTree(Data=dataforselectedversion_5, Masks=flatten("{?;2;2;*}"))  # -> Positive, Negative
split_7 = SplitTree(Data=dataforselectedversion_6, Masks=flatten("{?;5;1;*}"))  # -> Positive, Negative
layers = Data(merge)
composites = Data(merge_2)
homestory = Data(merge_3)
profile_2 = Data(profile)
buildingmat = Data(buildmat)
txt = Text(layers)
txt_2 = Text(split_3.Positive)
txt_3 = Text(composites)
txt_4 = Text(split_4.Positive)
txt_5 = Text(split_5.Positive)
txt_6 = Text(profile_2)
txt_7 = Text(split_6.Positive)
txt_8 = Text(buildingmat)
txt_9 = Text(split_7.Positive)
txt_10 = Text(homestory)
mindex = MemberIndex(Set=txt, Member=txt_2)  # -> Index, Count
mindex_2 = MemberIndex(Set=txt_3, Member=txt_4)  # -> Index, Count
mindex_3 = MemberIndex(Set=txt_10, Member=txt_5)  # -> Index, Count
mindex_4 = MemberIndex(Set=txt_6, Member=txt_7)  # -> Index, Count
mindex_5 = MemberIndex(Set=txt_8, Member=txt_9)  # -> Index, Count
shift = ShiftPaths(Data=mindex.Index, Offset=-1)
shift_2 = ShiftPaths(Data=mindex_2.Index, Offset=-1)
shift_3 = ShiftPaths(Data=mindex_3.Index, Offset=-1)
shift_4 = ShiftPaths(Data=mindex_4.Index, Offset=-1)
shift_5 = ShiftPaths(Data=mindex_5.Index, Offset=-1)
layers_2 = Data(layers)
composites_2 = Data(composites)
homestory_2 = Data(homestory)
profile_3 = Data(profile_2)
buildingmat_2 = Data(buildingmat)
item = ListItem(List=layers_2, Index=shift, Wrap=True)
item_2 = ListItem(List=composites_2, Index=shift_2, Wrap=True)
item_3 = ListItem(List=homestory_2, Index=shift_3, Wrap=True)
item_4 = ListItem(List=profile_3, Index=shift_4, Wrap=True)
item_5 = ListItem(List=buildingmat_2, Index=shift_5, Wrap=True)
layers_3 = Data(item)
composites_3 = DataDescription(item_2)
homestory_3 = Data(item_3)
profile_4 = DataDescription(item_4)
buildingmat_3 = DataDescription(item_5)
Y = UnitY(Factor=Slider(30000, range=0..100000))
split_8 = SplitTree(Data=layers_3, Masks=flatten("{?;0;5;*}"))  # -> Positive, Negative
split_9 = SplitTree(Data=layers_3, Masks=flatten("{?;1;4;*}"))  # -> Positive, Negative
split_10 = SplitTree(Data=layers_3, Masks=flatten("{?;2;3;*}"))  # -> Positive, Negative
split_11 = SplitTree(Data=layers_3, Masks=flatten("{?;3;1;*}"))  # -> Positive, Negative
split_12 = SplitTree(Data=layers_3, Masks=flatten("{?;5;2;*}"))  # -> Positive, Negative
split_13 = SplitTree(Data=layers_3, Masks=flatten("{?;6;3;*}"))  # -> Positive, Negative
split_14 = SplitTree(Data=composites_3, Masks=flatten("{?;0;1;*}"))  # -> Positive, Negative
split_15 = SplitTree(Data=composites_3, Masks=flatten("{?;1;1;*}"))  # -> Positive, Negative
split_16 = SplitTree(Data=homestory_3, Masks=flatten("{?;0;3;*}"))  # -> Positive, Negative
split_17 = SplitTree(Data=homestory_3, Masks=flatten("{?;1;3;*}"))  # -> Positive, Negative
split_18 = SplitTree(Data=homestory_3, Masks=flatten("{?;2;1;*}"))  # -> Positive, Negative
solidoperator3dtypelayer = RemoteSender(split_13.Positive)
wallshomestory_stripe = RemoteSender(split_17.Positive)
wallscomposite_stripe = RemoteSender(split_15.Positive)
wallshomestory_panel = RemoteSender(split_16.Positive)
wallscomposite_panel = RemoteSender(split_14.Positive)
buildingmat_4 = RemoteSender(buildingmat_3)
solidoperatorslayer = RemoteSender(split_11.Positive)
stripe3dtypelayer = RemoteSender(split_12.Positive)
wallslayer_stripe = RemoteSender(split_9.Positive)
wallslayer_panel = RemoteSender(split_8.Positive)
beamshomestory = RemoteSender(split_18.Positive)
beamlayer = RemoteSender(split_10.Positive)
profile_5 = RemoteSender(profile_4)
dataforselectedversion_7 = RemoteReceiver(dataforselectedversion)
dataforselectedversion_8 = RemoteReceiver(dataforselectedversion)
dataforselectedversion_9 = RemoteReceiver(dataforselectedversion)
dataforselectedversion_10 = RemoteReceiver(dataforselectedversion)
dataforselectedversion_11 = RemoteReceiver(dataforselectedversion)
dataforselectedversion_12 = RemoteReceiver(dataforselectedversion)
split_19 = SplitTree(Data=dataforselectedversion_7, Masks=flatten("{?;0;*}"))  # -> Positive, Negative
split_20 = SplitTree(Data=dataforselectedversion_8, Masks=flatten("{?;1;*}"))  # -> Positive, Negative
split_21 = SplitTree(Data=dataforselectedversion_9, Masks=flatten("{?;2;*}"))  # -> Positive, Negative
split_22 = SplitTree(Data=dataforselectedversion_10, Masks=flatten("{?;3;*}"))  # -> Positive, Negative
split_23 = SplitTree(Data=dataforselectedversion_11, Masks=flatten("{?;5;*}"))  # -> Positive, Negative
split_24 = SplitTree(Data=dataforselectedversion_12, Masks=flatten("{?;6;*}"))  # -> Positive, Negative
walls_panel = DataDescription(split_19.Positive)
walls_stripe = Data(split_20.Positive)
beam = Data(split_21.Positive)
solidoperator = Data(split_22.Positive)
stripe3dtype = Data(split_23.Positive)
solidoperator3dtype = Data(split_24.Positive)
split_25 = SplitTree(Data=walls_panel, Masks=flatten("{?;?;0;*}"))  # -> Positive, Negative
split_26 = SplitTree(Data=walls_panel, Masks=flatten("{?;?;2;*}"))  # -> Positive, Negative
split_27 = SplitTree(Data=walls_panel, Masks=flatten("{?;?;4;*}"))  # -> Positive, Negative
split_28 = SplitTree(Data=walls_stripe, Masks=flatten("{?;?;0;*}"))  # -> Positive, Negative
split_29 = SplitTree(Data=walls_stripe, Masks=flatten("{?;?;2;*}"))  # -> Positive, Negative
split_30 = SplitTree(Data=beam, Masks=flatten("{?;?;0;*}"))  # -> Positive, Negative
split_31 = SplitTree(Data=solidoperator, Masks=flatten("{?;?;0;*}"))  # -> Positive, Negative
split_32 = SplitTree(Data=stripe3dtype, Masks=flatten("{?;?;0;*}"))  # -> Positive, Negative
split_33 = SplitTree(Data=solidoperator3dtype, Masks=flatten("{?;?;0;*}"))  # -> Positive, Negative
split_34 = SplitTree(Data=solidoperator3dtype, Masks=flatten("{?;?;1;*}"))  # -> Positive, Negative
split_35 = SplitTree(Data=solidoperator3dtype, Masks=flatten("{?;?;2;*}"))  # -> Positive, Negative
split_36 = SplitTree(Data=solidoperator3dtype, Masks=flatten("{?;?;4;*}"))  # -> Positive, Negative
move = Move(Geometry=split_33.Positive, Motion=Y)  # -> Geometry, Transform
move_2 = Move(Geometry=split_34.Positive, Motion=Y)  # -> Geometry, Transform
move_3 = Move(Geometry=split_36.Positive, Motion=Y)  # -> Geometry, Transform
move_4 = Move(Geometry=split_32.Positive, Motion=Y)  # -> Geometry, Transform
move_5 = Move(Geometry=split_30.Positive, Motion=Y)  # -> Geometry, Transform
move_6 = Move(Geometry=split_25.Positive, Motion=Y)  # -> Geometry, Transform
move_7 = Move(Geometry=split_28.Positive, Motion=Y)  # -> Geometry, Transform
move_8 = Move(Geometry=split_31.Positive, Motion=Y)  # -> Geometry, Transform
solidoperator3dtypelayer_2 = RemoteReceiver(solidoperator3dtypelayer)
wallshomestory_stripe_2 = RemoteReceiver(wallshomestory_stripe)
wallshomestory_panel_2 = RemoteReceiver(wallshomestory_panel)
wallscomposite_stripe_2 = RemoteReceiver(wallscomposite_stripe)
wallscomposite_panel_2 = RemoteReceiver(wallscomposite_panel)
buildingmat_5 = RemoteReceiver(buildingmat_4)
solidoperatorslayer_2 = RemoteReceiver(solidoperatorslayer)
solidoperator3dtyperotation = Data(split_35.Positive)
solidoperator3dtyperotation_2 = Data(move_3.Geometry)
stripe3dtypelayer_2 = RemoteReceiver(stripe3dtypelayer)
wallslayer_stripe_2 = RemoteReceiver(wallslayer_stripe)
wallslayer_panel_2 = RemoteReceiver(wallslayer_panel)
beamshomestory_2 = RemoteReceiver(beamshomestory)
solidoperator3dtypestart = Data(move.Geometry)
solidoperator3dtypeend = Data(move_2.Geometry)
elementtype_panel = Data(split_27.Positive)
wallsheight_stripe = Data(split_29.Positive)
wallsheight_panel = Data(split_26.Positive)
facadetype_2 = RemoteReceiver(facadetype)
facadetype_3 = RemoteReceiver(facadetype)
solidoperatorsline = Data(move_8.Geometry)
facadetype_4 = RemoteReceiver(facadetype)
stripe3dtypemesh = Data(move_4.Geometry)
wallscurve_stripe = Data(move_7.Geometry)
wallscurve_panel = Data(move_6.Geometry)
beamlayer_2 = RemoteReceiver(beamlayer)
profile_6 = RemoteReceiver(profile_5)
beamsline = Data(move_5.Geometry)

# ----
# Solid operator 3d type
item_6 = ListItem(List=flatten(solidoperator3dtypelayer_2), Index=0, Wrap=True)
beamsetr = BeamSettingsRectangular(Height=30, Width=80, Layer=item_6, Height_2=30, Width_2=80, Layer_2=item_6, AC_ActiveState_Name="Rectangular")
rungeneration_2 = RemoteReceiver(rungeneration)
beam_2 = Beam(Synchronize=rungeneration_2, Curve=solidoperator3dtyperotation_2, BeamSettings=beamsetr)

rungeneration_3 = RemoteReceiver(rungeneration)

# ----
# Stripe
propset = PropertySettings(
    Facade_type=facadetype_3,
    Element_type="stripe",
    AC_Property_Param_Index=[0, 1],
    AC_Property_Param_Name=["Grasshopper_Facades_facade_type", "Grasshopper_Facades_element_type"])  # -> PropertySettings, ElementClassification
wallsetc = WallSettingsComposite(
    Composite=wallscomposite_stripe_2,
    Height=wallsheight_stripe,
    Layer=wallslayer_stripe_2,
    HomeStory=wallshomestory_stripe_2,
    PropertySettings=propset.PropertySettings,
    Composite_2=wallscomposite_stripe_2,
    Height_2=wallsheight_stripe,
    Layer_2=wallslayer_stripe_2,
    HomeStory_2=wallshomestory_stripe_2,
    PropertySettings_2=propset.PropertySettings,
    AC_ActiveState_Name="CompositeSlanted")
wall = Wall(Synchronize=rungeneration_3, Curve=wallscurve_stripe, WallSettings=wallsetc)

rungeneration_4 = RemoteReceiver(rungeneration)

# ----
# Stripe 3d type
propset_2 = PropertySettings(
    Facade_type=facadetype_4,
    Element_type="panel",
    AC_Property_Param_Index=[0, 1],
    AC_Property_Param_Name=["Grasshopper_Facades_facade_type", "Grasshopper_Facades_element_type"])  # -> PropertySettings, ElementClassification
morphset = MorphSettings(BuildingMaterial=buildingmat_5, Layer=stripe3dtypelayer_2, PropertySettings=propset_2.PropertySettings)
morphs = MorphSolid(Synchronize=rungeneration_4, Mesh=stripe3dtypemesh, MorphSettings=morphset)

rungeneration_5 = RemoteReceiver(rungeneration)

# ----
# Solid operator 3d type
columnsetr = ColumnSettingsRectangular(
    Depth=80,
    Width=30,
    RotationAngle=solidoperator3dtyperotation,
    Layer=solidoperator3dtypelayer_2,
    Depth_2=80,
    Width_2=30,
    RotationAngle_2=solidoperator3dtyperotation,
    Layer_2=solidoperator3dtypelayer_2,
    AC_ActiveState_Name="Rectangular")
column = Column(
    Synchronize=rungeneration_5,
    AnchorPoint=solidoperator3dtypestart,
    EndPoint=solidoperator3dtypeend,
    ColumnSettings=columnsetr)

rungeneration_6 = RemoteReceiver(rungeneration)

# ----
# Panel
propset_3 = PropertySettings(
    Facade_type=facadetype_2,
    Element_type=elementtype_panel,
    AC_Property_Param_Index=[0, 1],
    AC_Property_Param_Name=["Grasshopper_Facades_facade_type", "Grasshopper_Facades_element_type"])  # -> PropertySettings, ElementClassification
wallsetc_2 = WallSettingsComposite(
    Composite=wallscomposite_panel_2,
    Height=wallsheight_panel,
    Layer=wallslayer_panel_2,
    HomeStory=wallshomestory_panel_2,
    PropertySettings=propset_3.PropertySettings,
    Composite_2=wallscomposite_panel_2,
    Height_2=wallsheight_panel,
    Layer_2=wallslayer_panel_2,
    HomeStory_2=wallshomestory_panel_2,
    PropertySettings_2=propset_3.PropertySettings,
    AC_ActiveState_Name="CompositeSlanted")
wall_2 = Wall(Synchronize=rungeneration_6, Curve=wallscurve_panel, WallSettings=wallsetc_2)

rungeneration_7 = RemoteReceiver(rungeneration)

# ----
# Beam
beamsetp = BeamSettingsProfile(
    Profile=profile_6,
    Layer=beamlayer_2,
    HomeStory=beamshomestory_2,
    Profile_2=profile_6,
    Layer_2=beamlayer_2,
    HomeStory_2=beamshomestory_2,
    AC_ActiveState_Name="Profile")
beam_3 = Beam(Synchronize=rungeneration_7, Curve=beamsline, BeamSettings=beamsetp)

rungeneration_8 = RemoteReceiver(rungeneration)

# ----
# Solid operator
beamsetr_2 = BeamSettingsRectangular(
    Height=30,
    Width=80,
    Layer=solidoperatorslayer_2,
    Height_2=30,
    Width_2=80,
    Layer_2=solidoperatorslayer_2,
    AC_ActiveState_Name="Rectangular")
beam_4 = Beam(Synchronize=rungeneration_8, Curve=solidoperatorsline, BeamSettings=beamsetr_2)

clean = CleanTree(RemoveNulls=True, RemoveInvalid=True, RemoveEmpty=True, Tree=wall_2)
null = NullItem(Item=clean)  # -> NullFlags, InvalidFlags, Description
dataforselectedversion_13 = RemoteReceiver(dataforselectedversion)
cset = CreateSet(List=flatten(null.NullFlags))  # -> Set, Map
bool = Boolean(invert(cset.Set))
split_37 = SplitTree(Data=dataforselectedversion_13, Masks=flatten("{?;4;*}"))  # -> Positive, Negative
windows = Data(split_37.Positive)
split_38 = SplitTree(Data=windows, Masks=flatten("{?;?;5;*}"))  # -> Positive, Negative
split_39 = SplitTree(Data=windows, Masks=flatten("{?;?;0;*}"))  # -> Positive, Negative
split_40 = SplitTree(Data=windows, Masks=flatten("{?;?;1;*}"))  # -> Positive, Negative
split_41 = SplitTree(Data=windows, Masks=flatten("{?;?;2;*}"))  # -> Positive, Negative
split_42 = SplitTree(Data=windows, Masks=flatten("{?;?;3;*}"))  # -> Positive, Negative
split_43 = SplitTree(Data=windows, Masks=flatten("{?;?;4;*}"))  # -> Positive, Negative
maskforsplit = Data(split_38.Positive)
data_3 = Data(maskforsplit)
split_44 = SplitTree(Data=wall_2, Masks=flatten(data_3))  # -> Positive, Negative
windowssillheight = Data(split_41.Positive)
windowsheight = Data(split_43.Positive)
windowswidth = Data(split_42.Positive)
shift_6 = ShiftPaths(Data=split_44.Positive, Offset=-4)
item_7 = ListItem(List=shift_6, Index=1, Wrap=True)
split_45 = SplitTree(Data=windowssillheight, Masks=flatten("{*;0}"))  # -> Positive, Negative
split_46 = SplitTree(Data=windowssillheight, Masks=flatten("{*;1}"))  # -> Positive, Negative
split_47 = SplitTree(Data=windowssillheight, Masks=flatten("{*;2}"))  # -> Positive, Negative
split_48 = SplitTree(Data=windowswidth, Masks=flatten("{*;0}"))  # -> Positive, Negative
split_49 = SplitTree(Data=windowswidth, Masks=flatten("{*;1}"))  # -> Positive, Negative
split_50 = SplitTree(Data=windowswidth, Masks=flatten("{*;2}"))  # -> Positive, Negative
split_51 = SplitTree(Data=windowsheight, Masks=flatten("{*;0}"))  # -> Positive, Negative
split_52 = SplitTree(Data=windowsheight, Masks=flatten("{*;1}"))  # -> Positive, Negative
split_53 = SplitTree(Data=windowsheight, Masks=flatten("{*;2}"))  # -> Positive, Negative
windowshorisontaldistance = Data(split_39.Positive)
windowssillheight_double = Text(split_46.Positive)
windowssillheight_single = Text(split_45.Positive)
windowssillheight_triple = Text(split_47.Positive)
windowsheight_double = Text(split_52.Positive)
windowswidth_double = Text(split_49.Positive)
windowsheight_single = Text(split_51.Positive)
windowsheight_triple = Text(split_53.Positive)
windowswidth_single = Text(split_48.Positive)
windowswidth_triple = Text(split_50.Positive)
windowsorientation = Data(split_40.Positive)
walls = Data(item_7)
runwindowgeneration = Data(bool)
shift_7 = ShiftPaths(Data=windowshorisontaldistance, Offset=-1)
shift_8 = ShiftPaths(Data=windowsorientation, Offset=-1)

# ----
# Window
windowset = WindowSettings(
    SillHeight=windowssillheight_single,
    Width=windowswidth_single,
    Height=windowsheight_single,
    AC_GDL_Param_Index=[7, 8],
    AC_GDL_Param_Name=["A", "B"])  # -> WindowSettings, LibraryPart
windowset_2 = WindowSettings(
    SillHeight=windowssillheight_double,
    Width=windowswidth_double,
    Height=windowsheight_double,
    AC_GDL_Param_Index=[7, 8],
    AC_GDL_Param_Name=["A", "B"])  # -> WindowSettings, LibraryPart
windowset_3 = WindowSettings(
    SillHeight=windowssillheight_triple,
    Width=windowswidth_triple,
    Height=windowsheight_triple,
    AC_GDL_Param_Index=[7, 8],
    AC_GDL_Param_Name=["A", "B"])  # -> WindowSettings, LibraryPart
merge_4 = Merge(Data1=windowset.WindowSettings, Data2=windowset_2.WindowSettings, Data3=windowset_3.WindowSettings)
shift_9 = ShiftPaths(Data=merge_4, Offset=-2)
windowd = WindowDistance(
    Synchronize=runwindowgeneration,
    Wall=walls,
    HorizontalDistance=shift_7,
    Orientation=shift_8,
    RevealSide=True,
    WindowSettings=shift_9,
    AC_Window=(2, 0, 0))

dataforselectedversion_14 = RemoteReceiver(dataforselectedversion)
dataforselectedversion_15 = RemoteReceiver(dataforselectedversion)
dataforselectedversion_16 = RemoteReceiver(dataforselectedversion)
dataforselectedversion_17 = RemoteReceiver(dataforselectedversion)
dataforselectedversion_18 = RemoteReceiver(dataforselectedversion)
split_54 = SplitTree(Data=dataforselectedversion_18, Masks=flatten("{?;7;*}"))  # -> Positive, Negative
split_55 = SplitTree(Data=dataforselectedversion_14, Masks=flatten("{?;4;3;*}"))  # -> Positive, Negative
split_56 = SplitTree(Data=dataforselectedversion_14, Masks=flatten("{?;4;4;*}"))  # -> Positive, Negative
split_57 = SplitTree(Data=dataforselectedversion_14, Masks=flatten("{?;4;0;*}"))  # -> Positive, Negative
split_58 = SplitTree(Data=dataforselectedversion_14, Masks=flatten("{?;4;5;*}"))  # -> Positive, Negative
split_59 = SplitTree(Data=dataforselectedversion_15, Masks=flatten("{?;0;0;*}"))  # -> Positive, Negative
split_60 = SplitTree(Data=dataforselectedversion_15, Masks=flatten("{?;0;2;*}"))  # -> Positive, Negative
split_61 = SplitTree(Data=dataforselectedversion_15, Masks=flatten("{?;0;4;*}"))  # -> Positive, Negative
split_62 = SplitTree(Data=dataforselectedversion_16, Masks=flatten("{?;1;0;*}"))  # -> Positive, Negative
split_63 = SplitTree(Data=dataforselectedversion_16, Masks=flatten("{?;1;2;*}"))  # -> Positive, Negative
split_64 = SplitTree(Data=dataforselectedversion_17, Masks=flatten("{?;5;0;*}"))  # -> Positive, Negative
windowshorisontaldistance_2 = Data(split_57.Positive)
elementtype_panel_2 = Data(split_61.Positive)
wallsheight_stripe_2 = DataDescription(split_63.Positive)
wallsheight_panel_2 = Data(split_60.Positive)
facadetype_5 = RemoteReceiver(facadetype)
stripe3dtypemesh_2 = Data(split_64.Positive)
wallscurve_stripe_2 = DataDescription(split_62.Positive)
wallscurve_panel_2 = Data(split_59.Positive)
windowsheight_2 = Data(split_56.Positive)
windowswidth_2 = Data(split_55.Positive)
maskforsplit_2 = Data(split_58.Positive)
geomforpreview = Data(split_54.Positive)
Z = UnitZ(Factor=wallsheight_panel_2)
getcol = GetCol(S=elementtype_panel_2, G=facadetype_5)  # -> R, item_1
Z_2 = UnitZ(Factor=wallsheight_stripe_2)
mcol = MeshColours(Mesh=stripe3dtypemesh_2, Colours=ColourSwatch(SwatchColor=RGB(230, 230, 230)))
extr = Extrude(Base=wallscurve_panel_2, Direction=Z)
extr_2 = Extrude(Base=wallscurve_stripe_2, Direction=Z_2)
colorp_s = Data(getcol.R)
colors = Data(getcol.item_1)
wallscurve_panel_3 = Data(wallscurve_panel_2)
split_65 = SplitTree(Data=wallscurve_panel_3, Masks=flatten(maskforsplit_2))  # -> Positive, Negative
coloredmesh = Data(mcol)
preview = CustomPreview(Geometry=extr, Material=colorp_s)
preview_2 = CustomPreview(Geometry=extr_2, Material=colors)
shift_10 = ShiftPaths(Data=split_65.Positive, Offset=-2)
item_8 = ListItem(List=shift_10, Index=1, Wrap=True)
shift_11 = ShiftPaths(Data=windowswidth_2, Offset=-2)
shift_12 = ShiftPaths(Data=windowsheight_2, Offset=-2)
shift_13 = ShiftPaths(Data=windowshorisontaldistance_2, Offset=-1)
end = EndPoints(Curve=item_8)  # -> Start, End
division = Division(A=shift_11, B=2)
vec2pt = Vector2Pt(PointA=end.Start, PointB=end.End, Unitize=False)  # -> Vector, Length
amp = Amplitude(Vector=vec2pt.Vector, Amplitude=shift_13)
amp_2 = Amplitude(Vector=vec2pt.Vector, Amplitude=division)
move_9 = Move(Geometry=end.Start, Motion=amp)  # -> Geometry, Transform
rev = Reverse(Vector=amp_2)
move_10 = Move(Geometry=move_9.Geometry, Motion=amp_2)  # -> Geometry, Transform
move_11 = Move(Geometry=move_9.Geometry, Motion=rev)  # -> Geometry, Transform
Z_3 = UnitZ(Factor=shift_12)
ln = Line(StartPoint=move_10.Geometry, EndPoint=move_11.Geometry)
extr_3 = Extrude(Base=ln, Direction=Z_3)
evalsrf = EvaluateSurface(Surface=extr_3, Point="{0.5, 0.5, 0}")  # -> Point, expr("x*1", Normal), UDirection, VDirection, Frame
move_12 = Move(Geometry=extr_3, Motion=evalsrf.Normal)  # -> Geometry, Transform
preview_3 = CustomPreview(Geometry=move_12.Geometry, Material=ColourSwatch(SwatchColor=RGBA(183, 211, 237, 221)))

# ==== cluster GetCol
S = ClusterInput()
swatch = ColourSwatch(SwatchColor=RGB(71, 71, 71))
replace = ReplaceMembers(Set=S, Find=["panel", "stripe"], Replace=[0, 1])
data = Data(replace)
merge = Merge(Data1=swatch, Data2=swatch)
merge_2 = Merge(Data1=ColourSwatch(SwatchColor=RGB(161, 84, 87)), Data2=ColourSwatch(SwatchColor=RGB(71, 71, 71)))
merge_3 = Merge(Data1=ColourSwatch(SwatchColor=RGB(71, 71, 71)), Data2=ColourSwatch(SwatchColor=RGB(230, 230, 230)))
G = ClusterInput()
filter = StreamFilter(Gate=G, Stream1=merge, Stream2=merge_2, Stream3=merge_3)
item = ListItem(List=filter, Index=0, Wrap=True)  # -> Item, Item1
p_n_c = PickNChoose(Pattern=data, Stream0=item.Item, Stream1=item.Item1)
item_1 = ClusterOutput(item.Item1)
R = ClusterOutput(p_n_c)
