# Grasshopper definition SA-GH-Insolation.gh (Grasshopper 1.0.7)
# plug-ins: Heteroptera, treesloth01, Human UI, Pufferfish, Human, Moonlight, LunchBox, MetaHopper, Mouse Rat, Telepathy, HFTidyCanvas

ladybug = Ladybug_Ladybug()  # -> Vviiiiiiiiiizzz; plug-in component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
geo = Geometry([<brep referenced from the Rhino model> x184])
# INPUTS SetFloors | SetWindows
geo_2 = Geometry([<brep referenced from the Rhino model> x50])
panel = Panel(ladybug)
moonlight = Moonlight(Mode=Toggle(False))
geometry = DataDescription(geo)
context = Geometry(geo_2)
merge = Merge(Data1="data", Data2="data", Data3="data", Data4="data", Data6="data", Data7="data")
panel_2 = Panel("""Location: 
Month: 
Day: 
Hours:  
Boundary values
Interrupted: 
Uninterrupted: """)
data = Data(geometry)
result = DataDescription(merge)

# ---- group: Calculate
toggle = CreateToggle(Default=False, OnLabel="Calculate", OffLabel="Calculate")
adjustpos = AdjustElementPositioning(
    ElementsToAdjust=toggle,
    AbsolutePositioning=False,
    Width=Slider(139, range=100..200),
    HorizontalAlignment=0,
    VerticalAlignment=3)
button = DataDescription(toggle)
values = ValueListener(Elements=button, SomeProperty=True)  # -> Values, Indices

# ----
# UserInterfacer
pan = Panel("""Impact
Arial
Segoe UI
Calibri
Verdana
Minion Pro
Rosewood Std
Tw Cen MT
Proxima Nova""")

# ---- group: InputAdress
label = CreateLabel(LabelText="Adress", LabelSize=12, Justification=0)
textbox = CreateTextBox(UpdateButton=Toggle(False), showLabel=True)
adjustpos_2 = AdjustElementPositioning(ElementsToAdjust=textbox, AbsolutePositioning=False, Width=Slider(278, range=0..1000), HorizontalAlignment=3)
values_2 = ValueListener(Elements=textbox, SomeProperty=False)  # -> Values, Indices

# ---- group: InputAPIKey
label_2 = CreateLabel(LabelText="API Key", LabelSize=12, Justification=0)
textbox_2 = CreateTextBox(UpdateButton=Toggle(False), showLabel=True)
adjustpos_3 = AdjustElementPositioning(ElementsToAdjust=textbox_2, AbsolutePositioning=False, Width=Slider(278, range=0..1000), HorizontalAlignment=3)
values_3 = ValueListener(Elements=textbox_2, SomeProperty=False)  # -> Values, Indices

# ---- group: ShowInputDetails
checkbox = CreateCheckbox(Label="Show input details", StartingValue=False)
adjustpos_4 = AdjustElementPositioning(
    ElementsToAdjust=checkbox,
    AbsolutePositioning=False,
    Height=Slider(68, range=0..100),
    HorizontalAlignment=3,
    VerticalAlignment=3)
values_4 = ValueListener(Elements=checkbox, SomeProperty=True)  # -> Values, Indices

# ---- group: InputDetails
label_3 = CreateLabel(LabelText=panel_2, LabelSize=12, Justification=0)
label_4 = CreateLabel(LabelText=result, LabelSize=12, Justification=0)
entwine = Entwine(Branch00=label_3, Branch01=label_4, FlattenInputs=True)
setlabel = SetLabelContents(LabelToModify=label_4, NewLabelContents=result)

# ---- group: PreciseData
checkbox_2 = CreateCheckbox(Label="Precise data input", StartingValue=False)
adjustpos_5 = AdjustElementPositioning(
    ElementsToAdjust=checkbox_2,
    AbsolutePositioning=False,
    Height=Slider(67, range=0..100),
    HorizontalAlignment=3,
    VerticalAlignment=3)
values_5 = ValueListener(Elements=checkbox_2, SomeProperty=True)  # -> Values, Indices

# ----
# get wall surfaces
result_2 = DataDescription(graft(data))
debrep = DeconstructBrep(Brep=result_2)  # -> Faces, Edges, Vertices
evalsrf = EvaluateSurface(Surface=reparameterize(debrep.Faces), Point="{0.5, 0.5, 0}")  # -> Point, Normal, UDirection, VDirection, Frame
pdecon = Deconstruct(Point=evalsrf.Normal)  # -> XComponent, YComponent, ZComponent
dom = ConstructDomain(DomainStart=-0.99, DomainEnd=0.99)
inc = Includes(Value=pdecon.ZComponent, Domain=dom)  # -> Includes, Deviation
cull = CullPattern(List=debrep.Faces, CullPattern=inc.Includes)

list = ItemSelector(
    pan,
    {"Impact", "Arial", "Segoe UI", "Calibri", "Verdana", "Minion Pro", "Rosewood Std", "Tw Cen MT", "Proxima Nova"}, selected="Proxima Nova")
calculatebutton_value = Data(values.Values)
values_6 = DataDescription(values_5.Values)
launchwin = LaunchWindow(
    Show=Toggle(True),
    Name="Input data",
    Width=370,
    Height=Slider(500, range=100..500),
    FontFamily=list,
    ChildStatus=1,
    EnableHorizScroll=False)
label_5 = DataDescription(label)
data_2 = Data(textbox)
values_7 = DataDescription(values_2.Values)
label_6 = DataDescription(label_2)
data_3 = Data(textbox_2)
values_8 = DataDescription(values_3.Values)
data_4 = Data(entwine)
merge_2 = Merge(Data1=label_5, Data2=data_2)
merge_3 = Merge(Data1=label_6, Data2=data_3)
winprops = SetWindowProperties(Window=launchwin, AccentColor="Olive", ShowTitleBar=True, ScaleFactor=1)
simplegrid = CreateSimpleGrid(UIElements=data_4, RowDefinitions="Auto", ColumnDefinitions="Auto")  # -> flatten(SimpleGrid)
entwine_2 = Entwine(Branch00=merge_2, Branch01=merge_3, FlattenInputs=True)
hideshow = HideShowElement(ElementToHideShow=simplegrid, Show=values_4.Values, Collapse=True, Disable=False)
adjustelem = AdjustElementAppearance(ElementsToAdjust=simplegrid, Background=ColourSwatch(SwatchColor=RGB(214, 219, 213)))
flip = FlipMatrix(Data=entwine_2)
simplegrid_2 = CreateSimpleGrid(UIElements=flip, RowDefinitions="Auto", ColumnDefinitions="Auto")  # -> flatten(SimpleGrid)
data_5 = DataDescription(graft(cull))

# ----
# orient all surfaces (y=z)
rebsrf = RebuildSurface(Surface=data_5)
evalsrf_2 = EvaluateSurface(Surface=reparameterize(rebsrf), Point=".5,.5")  # -> Point, Normal, UDirection, VDirection, Frame
deplane = DeconstructPlane(Plane=evalsrf_2.Frame)  # -> Origin, XAxis, YAxis, ZAxis
pln = Plane(evalsrf_2.Frame)
Z = UnitZ(Factor=1)
angle = Angle(VectorA=deplane.YAxis, VectorB=Z)  # -> Angle, Reflex
equals = Equality(FirstNumber=angle.Angle, SecondNumber=3.141592654)  # -> Equality, Inequality
dispatch = Dispatch(List=pln, DispatchPattern=equals.Equality)  # -> ListA, ListB
revsrf = ReverseSurfaceDirection(Surface=rebsrf, ReverseOption=expr("x*2", equals.Equality))
rotate = Rotate(Geometry=dispatch.ListA, Angle="pi", Plane=dispatch.ListA)  # -> Geometry, Transform
merge_4 = Merge(Data1=rotate.Geometry, Data2=dispatch.ListB)
data_6 = DataDescription(revsrf)
clean = CleanTree(RemoveNulls=True, RemoveInvalid=True, RemoveEmpty=False, Tree=merge_4)
path_mapper = PathMapper(data_6, source="{A;B;C;D}", target="{B}")
c_script = CSharpScript(p=clean)  # -> out, A; inputs p: Plane
# ---------- c_script: C# ----------
    double x = 2;
    double y = 2;


    Interval a = new Interval (-x / 2, x / 2);
    Interval b = new Interval (-y / 2, y / 2);
    Rectangle3d r = new Rectangle3d (p, a, b);
    A = r;
# ---------- end c_script ----------

simple_grid = DataDescription(simplegrid_2)
checkbox_3 = DataDescription(checkbox)
text_block = DataDescription(simplegrid)
data_7 = Data(button)
toggle_2 = DataDescription(checkbox_2)

merge_5 = Merge(
    Data1=ColourSwatch(SwatchColor=RGB(230, 69, 96)),
    Data2=ColourSwatch(SwatchColor=RGB(252, 155, 43)),
    Data3=ColourSwatch(SwatchColor=RGB(255, 225, 0)),
    Data4=ColourSwatch(SwatchColor=RGB(154, 204, 53)),
    Data5=ColourSwatch(SwatchColor=RGB(254, 255, 250)))
merge_6 = Merge(
    Data1=ColourSwatch(SwatchColor=RGB(230, 64, 150)),
    Data2=ColourSwatch(SwatchColor=RGB(151, 147, 207)),
    Data3=ColourSwatch(SwatchColor=RGB(135, 206, 250)),
    Data4=ColourSwatch(SwatchColor=RGB(154, 204, 53)),
    Data5=ColourSwatch(SwatchColor=RGB(254, 255, 250)))
result_3 = DataDescription(merge_5)
result_4 = DataDescription(merge_6)
result_5 = Result(result_3)
result_6 = Result(result_4)
cull_i = CullIndex(List=result_5, Indices=[-2, -1], Wrap=True)
cull_i_2 = CullIndex(List=result_6, Indices=[-2, -1], Wrap=True)
item = ListItem(List=result_5, Index=[-2, -1], Wrap=True)
item_2 = ListItem(List=result_6, Index=[-2, -1], Wrap=True)
shift = ShiftPaths(Data=cull_i, Offset=-1)  # -> graft(Data)
shift_2 = ShiftPaths(Data=cull_i_2, Offset=-1)  # -> graft(Data)
entwine_3 = Entwine(Branch0X=shift, Branch1X=item, FlattenInputs=False)
entwine_4 = Entwine(Branch0X=shift_2, Branch1X=item_2, FlattenInputs=False)
renumber = RenumberPaths(Data=entwine_3)
renumber_2 = RenumberPaths(Data=entwine_4)

merge_7 = Merge(Data1=simple_grid, Data2=checkbox_3, Data3=text_block, Data4=toggle_2, Data5=data_7)
ui_calculatebutton = RemoteSender(calculatebutton_value)
ui_precisetoggle = RemoteSender(values_6)
ui_apikey = RemoteSender(values_8)
ui_adress = RemoteSender(values_7)
renumbered_data = RenumberedData(renumber)
renumbered_data_2 = RenumberedData(renumber_2)
data_8 = Data(path_mapper)
def_colour_uninterrupted = RemoteSender(renumbered_data)
def_colour_interrupted = RemoteSender(renumbered_data_2)

# ----
# cull surfaces inside of shape
data_9 = Data(data_8)
evalsrf_3 = EvaluateSurface(Surface=reparameterize(data_8), Point="{0.5, 0.5, 0}")  # -> Point, Normal, UDirection, VDirection, Frame
mesh = MeshBrep(
    Brep=data_8,
    Settings={GridMaxCount=0, GridMinCount=16, JaggedSeams=False, MaxEdgeLength=0, MinEdgeLength=0.0001, MinTolerance=0, Refine=True, RefineAngle=0, RelativeTolerance=0.65, SimplePlanes=True, Tolerance=0})  # -> flatten(Mesh)
move = Move(Geometry=evalsrf_3.Point, Motion=expr("x*2", evalsrf_3.Normal))  # -> Geometry, Transform
move_2 = Move(Geometry=evalsrf_3.Point, Motion=expr("-x*2", evalsrf_3.Normal))  # -> Geometry, Transform
mjoin = MeshJoin(Meshes=mesh)
ln = Line(StartPoint=move.Geometry, EndPoint=move_2.Geometry)
mcx = MeshCurve(Mesh=mjoin, Curve=ln)  # -> Points, Faces
lng = ListLength(List=mcx.Points)
equals_2 = Equality(FirstNumber=lng, SecondNumber=2)  # -> Equality, Inequality
dispatch_2 = Dispatch(List=graft(data_9), DispatchPattern=equals_2.Equality)  # -> ListA, ListB
data_10 = Data(dispatch_2.ListB)
shift_3 = ShiftPaths(Data=data_10, Offset=-1)

data_11 = Data(launchwin)
pan_2 = Panel("""Impact
Arial
Segoe UI
Calibri
Verdana
Minion Pro
Rosewood Std
Tw Cen MT
Proxima Nova""")
panel_3 = Panel("""0
1.5
2
2.5""")
panel_4 = Panel("""0
2
2.5
3""")
month = Slider(9, range=1..12)
day = Slider(22, range=1..31)
panel_5 = Panel("Period settings")
panel_6 = Panel("Calculate")
panel_7 = Panel("You can use \"/\" to set different floor height. Exemple: (Floor height: 4/3), (Number of floors: 1/30) - one floor is 4 m height, thirty floors are 3 m height.")
addelems = AddElements(Window=data_11, Elements=flatten(merge_7), DoVLChecking=True)  # -> AddedElements, ElementNames
list_2 = ItemSelector(
    pan_2,
    {"Impact", "Arial", "Segoe UI", "Calibri", "Verdana", "Minion Pro", "Rosewood Std", "Tw Cen MT", "Proxima Nova"}, selected="Proxima Nova")
A = DataDescription(c_script.A)
ui_precisetoggle_2 = RemoteReceiver(ui_precisetoggle)
panel_8 = Panel("Use existing windows")  # disabled
dispatch_3 = Dispatch(List=A, DispatchPattern=equals_2.Equality)  # -> ListA, ListB
number_slider = Slider(36, range=0..100)  # disabled

# ---- group: ObjectsForDataSaving
textbox_3 = CreateTextBox(UpdateButton=False, showLabel=True)
button_2 = CreateButton(ButtonName="Save", ButtonStyle=0)
label_7 = CreateLabel(LabelText="Template name", LabelSize=12, Justification=0)
label_tmpln = Data(label_7)
textbox_tmpln = Data(textbox_3)
buttonsave = Data(button_2)
merge_8 = Merge(Data1=label_tmpln, Data2=textbox_tmpln, Data3=buttonsave)
values_9 = ValueListener(Elements=buttonsave, SomeProperty=True)  # -> Values, Indices
values_10 = ValueListener(Elements=textbox_tmpln, Trigger=values_9.Values, SomeProperty=False)  # -> Values, Indices
adjustpos_6 = AdjustElementPositioning(ElementsToAdjust=textbox_tmpln, AbsolutePositioning=False, Width=Slider(164, range=0..1000), HorizontalAlignment=3)
adjustpos_7 = AdjustElementPositioning(ElementsToAdjust=buttonsave, AbsolutePositioning=False, Width=Slider(67, range=0..100), HorizontalAlignment=3)

# ----
clean_2 = CleanTree(RemoveNulls=True, RemoveInvalid=True, RemoveEmpty=True, Tree=dispatch_3.ListB)

# ---- group: CreateWindow
launchwin_2 = LaunchWindow(
    Show=ui_precisetoggle_2,
    Name="Precise input data",
    Width=370,
    Height=Slider(850, range=0..10000),
    FontFamily=list_2,
    ChildStatus=1,
    EnableHorizScroll=False)
winprops_2 = SetWindowProperties(Window=launchwin_2, AccentColor="Olive", ShowTitleBar=True, ScaleFactor=1)

# ----
checkbox_4 = CreateCheckbox(Label=panel_8, StartingValue=False)  # disabled
values_11 = ValueListener(Elements=checkbox_4, SomeProperty=True)  # -> Values, Indices; disabled
tree = DataDescription(clean_2)

# ---- group: ButtonForCalculation
checkbox_5 = CreateCheckbox(Label="Accept", StartingValue=False)
values_12 = ValueListener(Elements=checkbox_5, SomeProperty=True)  # -> Values, Indices
adjustpos_8 = AdjustElementPositioning(ElementsToAdjust=checkbox_5, AbsolutePositioning=False, HorizontalAlignment=1)
adjustelem_2 = AdjustElementAppearance(ElementsToAdjust=checkbox_5, FontSize=Slider(20, range=0..100))

# ----
data_12 = Data(values_11.Values)  # disabled
adjustpos_9 = AdjustElementPositioning(ElementsToAdjust=checkbox_4, AbsolutePositioning=False, Height=number_slider, VerticalAlignment=3)  # disabled
stack = CreateStack(UIElements=merge_8, Horizontal=True)
objectsfortmltsaving = Data(stack)
calculatebutton_value_2 = Data(values_12.Values)
ui_acceptdata = RemoteSender(calculatebutton_value_2)
ui_acceptdata_2 = RemoteReceiver(ui_acceptdata)
ui_acceptdata_3 = RemoteReceiver(ui_acceptdata)
ui_acceptdata_4 = RemoteReceiver(ui_acceptdata)
ui_acceptdata_5 = RemoteReceiver(ui_acceptdata)

# ---- group: SetTimeStep
label_8 = CreateLabel(LabelText="Time step", LabelSize=12, Justification=0)
textbox_4 = CreateTextBox(DefaultText="5", UpdateButton=False, showLabel=True)
values_13 = ValueListener(Elements=textbox_4, Trigger=ui_acceptdata_5, SomeProperty=False)  # -> Values, Indices
merge_9 = Merge(Data1=label_8, Data2=textbox_4)
adjustpos_10 = AdjustElementPositioning(ElementsToAdjust=textbox_4, AbsolutePositioning=False, HorizontalAlignment=3)
tooltip = AttachTooltipToElement(ElementsToAttachTo=merge_9, TooltipContent="Minutes", ShowDelay=500, Duration=2000)

# ---- group: SetLatitude
label_9 = CreateLabel(LabelText="Latitude", LabelSize=12, Justification=0)
textbox_5 = CreateTextBox(DefaultText="50", UpdateButton=False, showLabel=False)
merge_10 = Merge(Data1=label_9, Data2=textbox_5)
values_14 = ValueListener(Elements=textbox_5, Trigger=ui_acceptdata_2, SomeProperty=False)  # -> Values, Indices

# ---- group: SetLongitude
label_10 = CreateLabel(LabelText="Longitude", LabelSize=12, Justification=0)
textbox_6 = CreateTextBox(DefaultText="30", UpdateButton=False, showLabel=False)
merge_11 = Merge(Data1=label_10, Data2=textbox_6)
values_15 = ValueListener(Elements=textbox_6, Trigger=ui_acceptdata_2, SomeProperty=False)  # -> Values, Indices

# ---- group: SetTimeZone
label_11 = CreateLabel(LabelText="Time zone", LabelSize=12, Justification=0)
textbox_7 = CreateTextBox(DefaultText="2", UpdateButton=False, showLabel=False)
merge_12 = Merge(Data1=label_11, Data2=textbox_7)
values_16 = ValueListener(Elements=textbox_7, Trigger=ui_acceptdata_2, SomeProperty=False)  # -> Values, Indices

# ---- group: SetMonth
label_12 = CreateLabel(LabelText="Month", LabelSize=12, Justification=0)
slider = CreateSlider(Slider=month, SnapValue=1, ShowBounds=True, ShowTicks=True, ShowTooltip=False, ShowValLabel=True, showLabel=False)
merge_13 = Merge(Data1=label_12, Data2=slider)
values_17 = ValueListener(Elements=slider, Trigger=ui_acceptdata_5, SomeProperty=False)  # -> Values, Indices
setslider = SetSlider(UISlider=slider)

# ---- group: SetDay
label_13 = CreateLabel(LabelText="Day", LabelSize=12, Justification=0)
slider_2 = CreateSlider(Slider=day, SnapValue=1, ShowBounds=True, ShowTicks=True, ShowTooltip=False, ShowValLabel=True, showLabel=False)
merge_14 = Merge(Data1=label_13, Data2=slider_2)
values_18 = ValueListener(Elements=slider_2, Trigger=ui_acceptdata_5, SomeProperty=False)  # -> Values, Indices
setslider_2 = SetSlider(UISlider=slider_2)

# ---- group: SetHours
label_14 = CreateLabel(LabelText="Hours", LabelSize=12, Justification=0)
label_15 = CreateLabel(LabelText="from", LabelSize=12, Justification=0)
textbox_8 = CreateTextBox(DefaultText="7", UpdateButton=False, showLabel=True)
label_16 = CreateLabel(LabelText="to", LabelSize=12, Justification=0)
textbox_9 = CreateTextBox(DefaultText="17", UpdateButton=False, showLabel=True)
values_19 = ValueListener(Elements=textbox_8, SomeProperty=True)  # -> Values, Indices
values_20 = ValueListener(Elements=textbox_9, SomeProperty=True)  # -> Values, Indices
values_21 = ValueListener(Elements=textbox_8, Trigger=ui_acceptdata_5, SomeProperty=False)  # -> Values, Indices
values_22 = ValueListener(Elements=textbox_9, Trigger=ui_acceptdata_5, SomeProperty=False)  # -> Values, Indices

# ---- group: SetWindowWidth
textbox_10 = CreateTextBox(DefaultText="2", UpdateButton=False, showLabel=True)
label_17 = CreateLabel(LabelText="Window width", LabelSize=12, Justification=0)
values_23 = ValueListener(Elements=textbox_10, Trigger=ui_acceptdata_4, SomeProperty=False)  # -> Values, Indices
merge_15 = Merge(Data1=label_17, Data2=textbox_10)
tooltip_2 = AttachTooltipToElement(ElementsToAttachTo=merge_15, TooltipContent="Meters", ShowDelay=500, Duration=2000)

# ---- group: SetWindowHeight
textbox_11 = CreateTextBox(DefaultText="2", UpdateButton=False, showLabel=True)
label_18 = CreateLabel(LabelText="Window height", LabelSize=12, Justification=0)
values_24 = ValueListener(Elements=textbox_11, Trigger=ui_acceptdata_4, SomeProperty=False)  # -> Values, Indices
merge_16 = Merge(Data1=label_18, Data2=textbox_11)
tooltip_3 = AttachTooltipToElement(ElementsToAttachTo=merge_16, TooltipContent="Meters", ShowDelay=500, Duration=2000)

# ---- group: SetNumberOfFloors
textbox_12 = CreateTextBox(DefaultText="30", UpdateButton=False, showLabel=True)
label_19 = CreateLabel(LabelText="Number of floors", LabelSize=12, Justification=0)
values_25 = ValueListener(Elements=textbox_12, Trigger=ui_acceptdata_4, SomeProperty=False)  # -> Values, Indices
merge_17 = Merge(Data1=label_19, Data2=textbox_12)

# ---- group: SetFloorHeight
textbox_13 = CreateTextBox(DefaultText="3.00", UpdateButton=False, showLabel=True)
label_20 = CreateLabel(LabelText="Floor height", LabelSize=12, Justification=0)
values_26 = ValueListener(Elements=textbox_13, Trigger=ui_acceptdata_4, SomeProperty=False)  # -> Values, Indices
merge_18 = Merge(Data1=label_20, Data2=textbox_13)

# ---- group: SetBoundaryValues(Interrupt)
textbox_14 = CreateTextBox(DefaultText=panel_4, UpdateButton=False, showLabel=True)
textbox_15 = CreateTextBox(UpdateButton=False, showLabel=True)
label_21 = CreateLabel(LabelText="Boundary values for interrupted insolation", LabelSize=12, Justification=0)
merge_19 = Merge(Data1=textbox_14, Data2=textbox_15)
item_3 = ListItem(List=textbox_14, Index=0, Wrap=True)
stack_2 = CreateStack(UIElements=merge_19, Horizontal=True)
merge_20 = Merge(Data1=item_3, Data2=textbox_15)
values_27 = ValueListener(Elements=textbox_14, Trigger=ui_acceptdata_3, SomeProperty=False)  # -> Values, Indices
hideshow_2 = HideShowElement(ElementToHideShow=merge_20, Show=True, Collapse=False, Disable=True)
adjustpos_11 = AdjustElementPositioning(ElementsToAdjust=textbox_14, AbsolutePositioning=False, Width=Slider(33, range=0..100), HorizontalAlignment=3)
merge_21 = Merge(Data1=label_21, Data2=stack_2)  # -> flatten(Result)
stack_3 = CreateStack(UIElements=merge_21, Horizontal=False)

# ----
merge_22 = Merge(Data2=label_15, Data3=textbox_8, Data4=label_16, Data5=textbox_9)
hours_from_live = Data(values_19.Values)
hours_to_live = Data(values_20.Values)
merge_23 = Merge(Data1=merge_18, Data2=merge_17)
numberoffloors = Data(values_25.Values)
windowheight = Data(values_24.Values)
windowwidth = Data(values_23.Values)
floorheight = Data(values_26.Values)
stack_4 = CreateStack(UIElements=merge_22, Horizontal=True)

# ---- group: CreateGrid
entwine_5 = Entwine(Branch00=merge_10, Branch01=merge_11, Branch02=merge_12, FlattenInputs=True)
flip_2 = FlipMatrix(Data=entwine_5)
simplegrid_3 = CreateSimpleGrid(UIElements=flip_2, RowDefinitions="Auto", ColumnDefinitions="Auto")

# ----
tooltip_4 = AttachTooltipToElement(ElementsToAttachTo=merge_23, TooltipContent=panel_7, ShowDelay=500, Duration=20000)
merge_24 = Merge(Data1=label_14, Data2=stack_4)
hideshow_3 = HideShowElement(ElementToHideShow=merge_23, Show=Toggle(True), Collapse=True, Disable=False)
expander = CreateExpander(UIElements=simplegrid_3, Header="Location settings", Open=False)
entwine_6 = Entwine(Branch00=merge_24, Branch01=merge_9, FlattenInputs=True)
entwine_7 = Entwine(Branch00=merge_13, Branch01=merge_14, FlattenInputs=True)
data_13 = Data(checkbox_4)  # disabled
entwine_8 = Entwine(Branch00=merge_18, Branch01=merge_17, Branch02=merge_16, Branch03=merge_15, FlattenInputs=True)
path_mapper_2 = PathMapper(graft(shift_3))
flip_3 = FlipMatrix(Data=entwine_8)

# ---- group: CreateGrid
flip_4 = FlipMatrix(Data=entwine_7)
flip_5 = FlipMatrix(Data=entwine_6)
simplegrid_4 = CreateSimpleGrid(UIElements=flip_4, RowDefinitions="Auto", ColumnDefinitions="Auto")
simplegrid_5 = CreateSimpleGrid(UIElements=flip_5, RowDefinitions="Auto", ColumnDefinitions="Auto")

# ----
tree_2 = Tree(tree)
simplegrid_6 = CreateSimpleGrid(UIElements=flip_3, RowDefinitions="Auto", ColumnDefinitions="Auto")  # -> flatten(SimpleGrid)

# ----
# cull small surfaces
dim = Dimensions(Surface=path_mapper_2)  # -> UDimension, VDimension
u_dimension = DataDescription(dim.UDimension)
smaller = SmallerThan(FirstNumber=u_dimension, SecondNumber="2")  # -> SmallerThan, OrEqualTo
dispatch_4 = Dispatch(List=u_dimension, DispatchPattern=invert(smaller.SmallerThan))  # -> ListA, ListB
dispatch_5 = Dispatch(List=path_mapper_2, DispatchPattern=invert(smaller.SmallerThan))  # -> ListA, ListB
clean_3 = CleanTree(RemoveNulls=True, RemoveInvalid=True, RemoveEmpty=True, Tree=dispatch_5.ListA)
clean_4 = CleanTree(RemoveNulls=True, RemoveInvalid=True, RemoveEmpty=True, Tree=dispatch_4.ListA)

data_14 = Data(data_13)
merge_25 = Merge(Data1=data_14, Data2=simplegrid_6)
expander_2 = CreateExpander(UIElements=merge_25, Header="Geometry settings", Open=False)
merge_26 = Merge(Data1=flatten(simplegrid_4), Data2=flatten(simplegrid_5))
dispatch_6 = Dispatch(List=tree_2, DispatchPattern=invert(smaller.SmallerThan))  # -> ListA, ListB
expander_3 = CreateExpander(UIElements=merge_26, Header="Period settings", Open=False)
clean_5 = CleanTree(RemoveNulls=True, RemoveInvalid=True, RemoveEmpty=True, Tree=dispatch_6.ListA)
ui_fordomain_interrupt = RemoteSender(values_27.Values)
ui_fordomain_interrupt_2 = RemoteReceiver(ui_fordomain_interrupt)
data_15 = Data(flatten(ui_fordomain_interrupt_2))
ui_toggleexistigwindows = RemoteSender(data_12)
ui_numberoffloors = RemoteSender(numberoffloors)
ui_numberoffloors_2 = RemoteReceiver(ui_numberoffloors)
ui_hours_from_live = RemoteSender(hours_from_live)
ui_windowheight = RemoteSender(windowheight)
ui_windowwidth = RemoteSender(windowwidth)
ui_hours_to_live = RemoteSender(hours_to_live)
ui_hours_from = RemoteSender(values_21.Values)
ui_hours_from_2 = RemoteReceiver(ui_hours_from)
ui_floorheight = RemoteSender(floorheight)
ui_floorheight_2 = RemoteReceiver(ui_floorheight)

# ----
# create stack
split = TextSplit(Text=ui_floorheight_2, Separators="/")
split_2 = TextSplit(Text=ui_numberoffloors_2, Separators="/")
stack_5 = StackData(Data=split, Stack=split_2)
ins = InsertItems(List=stack_5, Item=0, Indices=0, Wrap=True)

data_16 = Data(ins)
tree_3 = DataDescription(clean_3)
tree_4 = DataDescription(clean_4)
ui_longitude = RemoteSender(values_15.Values)
ui_time_zone = RemoteSender(values_16.Values)
ui_hours_to = RemoteSender(values_22.Values)
ui_hours_to_2 = RemoteReceiver(ui_hours_to)
subtraction = Subtraction(A=ui_hours_to_2, B=ui_hours_from_2)
hoursofins = DataDescription(subtraction)
ui_timestep = RemoteSender(values_13.Values)
ui_latitude = RemoteSender(values_14.Values)
ui_month = RemoteSender(values_17.Values)
ui_day = RemoteSender(values_18.Values)
_1stexpander = Data(expander_2)
_2dexpander = Data(expander)
_3dexpander = Data(expander_3)
data_17 = DataDescription(objectsfortmltsaving)
tmplname = Data(values_10.Values)
savetemplate = Data(values_9.Values)
subtraction_2 = Subtraction(A=ui_hours_to_live, B=ui_hours_from_live)
data_18 = DataDescription(data_16)
srf = Surface(reparameterize(tree_3))
division = Division(A=tree_4, B="3")
ui_hoursdifference = RemoteSender(subtraction_2)
ui_hoursdifference_2 = RemoteReceiver(ui_hoursdifference)
settextbox = SetTextBoxContents(TextBoxToModify=textbox_15, NewTextBoxContents=ui_hoursdifference_2)
round = Round(Number=division)  # -> Nearest, Floor, Ceiling

# ----
# get floors by surface v
dim_2 = Dimensions(Surface=srf)  # -> graft(UDimension), graft(VDimension)
ma = MassAddition(Input=data_18)  # -> Result, PartialResults
v_dimension = DataDescription(dim_2.VDimension)
smaller_2 = SmallerThan(FirstNumber=ma.PartialResults, SecondNumber=v_dimension)  # -> SmallerThan, OrEqualTo
data_19 = Data(v_dimension)
data_20 = Data(ma.PartialResults)
dispatch_7 = Dispatch(List=data_20, DispatchPattern=smaller_2.SmallerThan)  # -> ListA, ListB
list_a = DataDescription(dispatch_7.ListA)

data_21 = Data(round.Nearest)
textbox_floorh = Data(textbox_13)
textbox_floorc = Data(textbox_12)
textbox_windowh = Data(textbox_11)
textbox_windoww = Data(textbox_10)
textbox_setlat = DataDescription(textbox_5)
textbox_setlong = DataDescription(textbox_6)
textbox_timezone = DataDescription(textbox_7)
slider_month = DataDescription(slider)
slider_day = DataDescription(slider_2)
textbox_hoursfrom = DataDescription(textbox_8)
textbox_hoursto = DataDescription(textbox_9)
textbox_timestep = DataDescription(textbox_4)
textboxes_bvint = DataDescription(textbox_14)
calculatebutton = Data(checkbox_5)
panel_9 = Panel("""Ctrl + Left Click on building shape shows statistic for selected building
Ctrl + Left Click on empty space shows statistic for all site""")
def_colour_uninterrupted_2 = RemoteReceiver(def_colour_uninterrupted)
def_colour_interrupted_2 = RemoteReceiver(def_colour_interrupted)
panel_10 = Panel("Statistics for site/selected building")
data_22 = Data(v_dimension)
ui_calculatebutton_2 = RemoteReceiver(ui_calculatebutton)
panel_11 = Panel("""Show rays
Show cutted volumes
Show sunpath""")
getscreen = GetScreenDimensions()  # -> Width, Height
data_23 = Data(Tree({0}: [RGB(230, 64, 150)], {1}: [RGB(151, 147, 207)], {2}: [RGB(135, 206, 250)], {3}: [RGB(154, 204, 53), RGB(254, 255, 250)]))
data_24 = Data(Tree({0}: [RGB(230, 69, 96)], {1}: [RGB(252, 155, 43)], {2}: [RGB(255, 225, 0)], {3}: [RGB(154, 204, 53), RGB(254, 255, 250)]))
data_25 = Data(Tree({0}: ["2.93"], {1}: ["0.23"], {2}: ["2.70"], {3}: ["22.30"]))
data_26 = Data([Domain(0, 2), Domain(2, 2.5), Domain(2.5, 3), Domain(3, 10)])
data_27 = Data([Domain(0, 1.5), Domain(1.5, 2), Domain(2, 2.5), Domain(2.5, 10)])
data_28 = Data(Tree({0}: ["25.45"], {1}: ["4.95"], {2}: ["3.60"], {3}: ["37.84"]))

# ---- group: AnalysisToggle
panel_12 = DataDescription("")
toggle_3 = CreateToggle(Default=False, Label=panel_12, OnLabel="Analysis", OffLabel="Analysis")
label_22 = CreateLabel(LabelText="Point checker", LabelSize=18, Justification=2)
num = Number("20")
values_28 = ValueListener(Elements=toggle_3, SomeProperty=True)  # -> Values, Indices
adjustpos_12 = AdjustElementPositioning(
    ElementsToAdjust=label_22,
    AbsolutePositioning=False,
    Width=Slider(253, range=0..1000),
    HorizontalAlignment=3,
    VerticalAlignment=0)
adjustelem_3 = AdjustElementAppearance(ElementsToAdjust=label_22, FontSize=20)
setprop = SetElementProperty(UIElement=toggle_3, PropertyName="FontSize", ValueToSet=num)
entwine_9 = Entwine(Branch00=toggle_3, Branch01=label_22, FlattenInputs=True)  # -> flatten(Result)
stack_6 = CreateStack(UIElements=entwine_9, Horizontal=True)

# ----
analysistoggle_value = Data(values_28.Values)
analysistoggle = Data(stack_6)
ui_toggle_analysis = RemoteSender(analysistoggle_value)
boolean = DataDescription(ui_calculatebutton_2)
clearallstates = Button()
ui_toggle_analysis_2 = RemoteReceiver(ui_toggle_analysis)
ui_toggle_analysis_3 = RemoteReceiver(ui_toggle_analysis)
ui_toggle_analysis_4 = RemoteReceiver(ui_toggle_analysis)
data_29 = Data(srf)
data_30 = DataDescription(data_21)
data_31 = DataDescription(data_22)
_1stexpander_2 = Data(_1stexpander)
_2dexpander_2 = Data(_2dexpander)
_3dexpander_2 = Data(_3dexpander)
buttoncalculate = Data(data_17)
buttoncalculate_2 = Data(calculatebutton)
pan_3 = Panel("""Impact
Arial
Segoe UI
Calibri
Verdana
Minion Pro
Rosewood Std
Tw Cen MT
Proxima Nova""")

# ---- group: ShowRays/Volumes/Sunpath
panel_13 = DataDescription("")
toggle_4 = CreateToggle(Default=False, Label=panel_13, OnLabel=panel_13, OffLabel=panel_13)
toggle_5 = CreateToggle(Default=False, Label=panel_13, OnLabel=panel_13, OffLabel=panel_13)
toggle_6 = CreateToggle(Default=False, Label=panel_13, OnLabel=panel_13, OffLabel=panel_13)
label_23 = CreateLabel(LabelText=panel_11, LabelSize=12, Justification=0)
merge_27 = Merge(Data1=toggle_4, Data2=toggle_5, Data3=toggle_6)
entwine_10 = Entwine(Branch00=label_23, Branch01=merge_27, FlattenInputs=True)
adjustelem_4 = AdjustElementAppearance(ElementsToAdjust=label_23, FontSize=20)
simplegrid_7 = CreateSimpleGrid(UIElements=entwine_10, RowDefinitions="Auto", ColumnDefinitions="Auto")
adjustpos_13 = AdjustElementPositioning(ElementsToAdjust=label_23, AbsolutePositioning=False, VerticalAlignment=0)
adjustpos_14 = AdjustElementPositioning(
    ElementsToAdjust=merge_27,
    AbsolutePositioning=False,
    Width=Slider(153, range=0..1000),
    HorizontalAlignment=2,
    VerticalAlignment=0)
hideshow_4 = HideShowElement(ElementToHideShow=simplegrid_7, Show=ui_toggle_analysis_4, Collapse=True, Disable=False)
values_29 = ValueListener(Elements=toggle_4, SomeProperty=True)  # -> Values, Indices
values_30 = ValueListener(Elements=toggle_5, SomeProperty=True)  # -> Values, Indices
values_31 = ValueListener(Elements=toggle_6, SomeProperty=True)  # -> Values, Indices

# ----
panel_14 = Panel("Playfair Display")
panel_15 = Panel("Montserrat")

# ---- group: ShowLegende
panel_16 = DataDescription("")
toggle_7 = CreateToggle(Default=False, Label=panel_16, OnLabel=panel_16, OffLabel=panel_16)
label_24 = CreateLabel(LabelText="Show legend", LabelSize=12, Justification=0)
entwine_11 = Entwine(Branch00=label_24, Branch01=toggle_7, FlattenInputs=True)
adjustelem_5 = AdjustElementAppearance(ElementsToAdjust=label_24, FontSize=20)
simplegrid_8 = CreateSimpleGrid(UIElements=entwine_11, RowDefinitions="Auto", ColumnDefinitions="Auto")
adjustpos_15 = AdjustElementPositioning(ElementsToAdjust=label_24, AbsolutePositioning=False, VerticalAlignment=0)
adjustpos_16 = AdjustElementPositioning(
    ElementsToAdjust=toggle_7,
    AbsolutePositioning=False,
    Width=Slider(224, range=0..1000),
    HorizontalAlignment=2,
    VerticalAlignment=0)
values_32 = ValueListener(Elements=toggle_7, SomeProperty=True)  # -> Values, Indices

# ----
list_3 = ItemSelector(
    pan_3,
    {"Impact", "Arial", "Segoe UI", "Calibri", "Verdana", "Minion Pro", "Rosewood Std", "Tw Cen MT", "Proxima Nova"}, selected="Proxima Nova")

# ---- group: Label(Percentage/Time)
label_25 = CreateLabel(LabelSize=18, Justification=0)
analysistrigger = Data(ui_toggle_analysis_3)
filter = StreamFilter(Gate=analysistrigger, Stream0="PERCENTAGE OF INSOLATED POINT", Stream1="INSOLATION TIME IN POINT")
adjustelem_6 = AdjustElementAppearance(ElementsToAdjust=label_25, Foreground=ColourSwatch(SwatchColor=RGB(0, 0, 0)), FontSize=20)
setlabel_2 = SetLabelContents(LabelToModify=label_25, NewLabelContents=filter)

# ---- group: CreateWindow(Analysis)
launchxpwin = LaunchTransparentWindow(
    Show=boolean,
    Name="Control Window",
    Width=300,
    Height=Slider(745, range=0..1000),
    FontFamily=list_3,
    ChildStatus=1,
    EnableHorizScroll=False)
multiplication = Multiplication(A=getscreen.Width, B=Slider(0.027, range=0..0.1))
multiplication_2 = Multiplication(A=getscreen.Height, B=Slider(0.141, range=0..1))
pt = ConstructPoint(XCoordinate=multiplication, YCoordinate=multiplication_2, ZCoordinate=0)
windowresults = Data(launchxpwin)
winprops_3 = SetWindowProperties(
    Window=windowresults,
    StartingLocation=pt,
    AccentColor="Steel",
    ShowTitleBar=Toggle(True),
    BackgroundColor=ColourSwatch(SwatchColor=RGB(255, 255, 255)),
    ScaleFactor=Slider(0.7, range=0..1))

# ----
toggle_showlegendvalue = Data(values_32.Values)
tree_5 = DataDescription(clean_5)
ui_windowheight_2 = RemoteReceiver(ui_windowheight)
number_slider_2 = WindowHeight(ui_windowheight_2)  # disabled
ui_windowwidth_2 = RemoteReceiver(ui_windowwidth)
number_slider_3 = WindowWidth(ui_windowwidth_2)  # disabled
xy = XYPlane(Origin=Point(0, 0, 0))
number_slider_4 = WindowHeight(ui_windowheight_2)
number_slider_5 = WindowWidth(ui_windowwidth_2)
windowresults_2 = Data(windowresults)
label_percentage_time = Data(label_25)
analysistoggle_2 = Data(analysistoggle)
toggle_showlegend = Data(simplegrid_8)
toggle_showrays = Data(values_29.Values)
gridoftoggles = DataDescription(simplegrid_7)
toggle_showvolumes = Data(values_30.Values)
toggle_showsunpath = Data(values_31.Values)
ui_toggle_showvolumes = RemoteSender(toggle_showvolumes)
ui_toggle_showlegend = RemoteSender(toggle_showlegendvalue)
ui_toggle_showsunpath = RemoteSender(toggle_showsunpath)
ui_toggle_showrays = RemoteSender(toggle_showrays)
geometry_2 = Geometry(geometry)
context_2 = Data(context)
def_colour_uninterrupted_3 = RemoteReceiver(def_colour_uninterrupted)
ui_toggle_showlegend_2 = RemoteReceiver(ui_toggle_showlegend)
def_colour_interrupted_3 = RemoteReceiver(def_colour_interrupted)
getscreen_2 = GetScreenDimensions()  # -> Width, Height
number_slider_6 = DataDescription(Slider(0.388, range=0..1))
label_percentage_time_2 = DataDescription(label_percentage_time)
analysistoggle_3 = DataDescription(analysistoggle_2)
toggle_showlegend_2 = Data(toggle_showlegend)
gridoftoggles_2 = Data(gridoftoggles)

# ---- group: WindowLegend
subtraction_3 = Subtraction(A=getscreen_2.Height, B=273)
launchxpwin_2 = LaunchTransparentWindow(
    Show=ui_toggle_showlegend_2,
    Name="Control Window",
    Width=100,
    Height=subtraction_3,
    ChildStatus=1,
    EnableHorizScroll=False)
multiplication_3 = Multiplication(A=getscreen_2.Width, B=number_slider_6)
multiplication_4 = Multiplication(A=getscreen_2.Height, B=Slider(0.141, range=0..1))
pt_2 = ConstructPoint(XCoordinate=multiplication_3, YCoordinate=multiplication_4, ZCoordinate=0)
window_legend = Data(launchxpwin_2)
winprops_4 = SetWindowProperties(
    Window=window_legend,
    StartingLocation=pt_2,
    ShowTitleBar=False,
    BackgroundColor=ColourSwatch(SwatchColor=RGBA(255, 255, 255, 0)),
    ScaleFactor=Slider(0.75, range=0..1))

# ----
windowresults_3 = Data(windowresults_2)

# ---- group: GetMainLegendLine
subtraction_4 = Subtraction(A=getscreen_2.Height, B=Slider(50, range=0..1000))
division_2 = Division(A=subtraction_4, B=2)
neg = Negative(Value=division_2)
pt_3 = ConstructPoint(XCoordinate=0, YCoordinate=division_2, ZCoordinate=0)
pt_4 = ConstructPoint(XCoordinate=0, YCoordinate=neg, ZCoordinate=0)
ln_2 = Line(StartPoint=pt_4, EndPoint=pt_3)

# ---- group: Label(Legend)
label_26 = CreateLabel(LabelText="Legend", LabelSize=18, Justification=0)
label_legend = Data(label_26)

# ---- group: Label(UNinterrupted)
label_27 = CreateLabel(LabelText="Direct", LabelSize=12, Justification=0)
label_uninterrupted = Data(label_27)
adjustelem_7 = AdjustElementAppearance(ElementsToAdjust=label_27, FontSize=Slider(17, range=0..100))

# ---- group: Label(Interrupted)
label_28 = CreateLabel(LabelText="Interrupted", LabelSize=12, Justification=0)
label_interrupted = Data(label_28)
adjustelem_8 = AdjustElementAppearance(ElementsToAdjust=label_28, FontSize=Slider(17, range=0..100))

# ----
flip_6 = FlipCurve(Curve=ln_2)  # -> Curve, Flag
ui_hours_from_3 = RemoteReceiver(ui_hours_from)
ui_longitude_2 = RemoteReceiver(ui_longitude)
ui_time_zone_2 = RemoteReceiver(ui_time_zone)
ui_hours_to_3 = RemoteReceiver(ui_hours_to)
# CalculationBlock
ui_timestep_2 = RemoteReceiver(ui_timestep)
ui_latitude_2 = RemoteReceiver(ui_latitude)
ui_apikey_2 = RemoteReceiver(ui_apikey)
ui_month_2 = RemoteReceiver(ui_month)
ui_adress_2 = RemoteReceiver(ui_adress)
ui_day_2 = RemoteReceiver(ui_day)
getmainlegendline = Data(flip_6.Curve)
division_3 = Division(A=60, B=ui_timestep_2)

# ----
# DataFrom"Template"(WIP)
locationfinder = Ladybug_LocationFinder(address=ui_adress_2, APIKey=ui_apikey_2)  # -> readMe, location; plug-in component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
data_32 = Data(locationfinder.location)
data_33 = Data()
data_34 = DataDescription(data_33)

toggle_8 = BooleanToggle(True)
result_7 = Result(division_3)
result_8 = Result(result_7)  # disabled
result_9 = Data(result_7)
label_legend_2 = Data(label_legend)
label_uninterrupted_2 = Data(label_uninterrupted)
window_legend_2 = Data(window_legend)
label_interrupted_2 = Data(label_interrupted)
number_slider_7 = Slider(2, range=0..10)  # disabled
result_10 = Result(result_8)  # disabled
def_colour_uninterrupted_4 = RemoteReceiver(def_colour_uninterrupted)  # disabled
def_colour_interrupted_4 = RemoteReceiver(def_colour_interrupted)  # disabled
renumbered_data_3 = DataDescription(def_colour_uninterrupted_4)  # disabled
renumbered_data_4 = DataDescription(def_colour_interrupted_4)  # disabled
result_11 = DataDescription(result_9)
def_colour_uninterrupted_5 = RemoteReceiver(def_colour_uninterrupted)
def_colour_interrupted_5 = RemoteReceiver(def_colour_interrupted)
renumbered_data_5 = Result(def_colour_uninterrupted_5)
renumbered_data_6 = Result(def_colour_interrupted_5)
entwine_12 = Entwine(Branch0X=renumbered_data_5, Branch1X=renumbered_data_5, Branch2X=renumbered_data_6, FlattenInputs=False)
colours = DataDescription(entwine_12)
colours_2 = Data(colours)
division_4 = Division(A=60, B=Slider(1, range=0..10))
result_12 = DataDescription(division_4)
zero = DataDescription("0")
Z_2 = UnitZ(Factor=100)
ui_toggle_showvolumes_2 = RemoteReceiver(ui_toggle_showvolumes)
ui_toggle_showsunpath_2 = RemoteReceiver(ui_toggle_showsunpath)
ui_toggle_showrays_2 = RemoteReceiver(ui_toggle_showrays)
material = CreateMaterial(Diffuse=RGB(150, 150, 150), Specular=RGB(255, 255, 255), Emission=RGB(120, 120, 120), Transparency=0, Shine=0)
hideshow_5 = HideShowObjectPreview(Visible=ui_toggle_showsunpath_2, AllObjects_Object=[data_70, data_69, data_71])
hideshow_6 = HideShowObjectPreview(Visible=ui_toggle_showrays_2, AllObjects_Object=[preview_4, textbaker])
hideshow_7 = HideShowObjectPreview(Visible=ui_toggle_showvolumes_2, AllObjects_Object=preview_3)

merge_28 = Merge(Data1=data_15, Data2=hoursofins)
result_13 = DataDescription(merge_28)
result_14 = Result(result_13)
cull_i_3 = CullIndex(List=result_14, Indices=-1, Wrap=True)
cull_i_4 = CullIndex(List=result_14, Indices=0, Wrap=True)
dom_2 = ConstructDomain(DomainStart=cull_i_3, DomainEnd=expr("x", cull_i_4))

domainsinterruptedins = DataDescription(dom_2)
def_domain_interrupted = RemoteSender(domainsinterruptedins)
def_domain_interrupted_2 = RemoteReceiver(def_domain_interrupted)
def_domain_interrupted_3 = RemoteReceiver(def_domain_interrupted)

# ---- group: GetValuesColours(Interrupted)
dedomain = DeconstructDomain(Domain=def_domain_interrupted_3)  # -> Start, End
data_35 = Data(dedomain.End)
data_36 = Data(dedomain.Start)
item_4 = ListItem(List=data_36, Index=-1, Wrap=True)
item_5 = ListItem(List=data_35, Index=-1, Wrap=True)
merge_29 = Merge(Data1=data_36, Data2=item_5)
subtraction_5 = Subtraction(A=item_5, B=item_4)
division_5 = Division(A=subtraction_5, B="0.5")
result_15 = DataDescription(merge_29)
series = Series(Start=item_4, Step="0.5", Count=division_5)
data_37 = Data(def_colour_interrupted_3)
tstat = TreeStatistics(Tree=data_37)  # -> Paths, Length, Count
shift_4 = ShiftPaths(Data=series, Offset=-1)
item_6 = ListItem(List=tstat.Paths, Index=-1, Wrap=True)
neg_2 = Negative(Value=result_15)  # -> reverse(Result)
cull_i_5 = CullIndex(List=shift_4, Indices=0, Wrap=True)
split_3 = SplitTree(Data=data_37, Masks=flatten(item_6))  # -> Positive, Negative
merge_30 = Merge(Data1=shift_4, Data2=item_5)
shift_5 = ShiftPaths(Data=cull_i_5, Offset=-1)
bnd = Bounds(Numbers=merge_30)
long = LongestList(ListA=shift_5, PaddingMode=2)  # -> ListA, ListB
cull_i_6 = CullIndex(List=long.ListB, Indices=0, Wrap=True)
remap = RemapNumbers(Value=merge_30, Source=bnd, Target=Domain(0, 1))  # -> Mapped, Clipped
shift_6 = ShiftPaths(Data=cull_i_6, Offset=-1)
interp = InterpolateData(Data=split_3.Positive, Parameter=remap.Mapped, Interpolation=2)
merge_31 = Merge(Data1=data_36, Data2=shift_6, Data3=item_5)
merge_32 = Merge(Data1=data_36, Data2=shift_5, Data3=item_5)
shift_7 = ShiftPaths(Data=interp, Offset=-1)
cull_i_7 = CullIndex(List=shift_7, Indices=-1, Wrap=True)
neg_3 = Negative(Value=merge_32)  # -> reverse(Result)
entwine_13 = Entwine(Branch0X=split_3.Negative, Branch1X=cull_i_7, FlattenInputs=False)

# ----
interruptedbvalues = Result(neg_2)
data_38 = Data(merge_31)
interruptedvalues = Data(neg_3)
interruptedcolours = Data(entwine_13)
data_39 = DataDescription(data_38)
def_domain_interrupted_4 = RemoteReceiver(def_domain_interrupted)  # disabled
remote_receiver = DataDescription(def_domain_interrupted_4)  # disabled
def_domain_interrupted_5 = RemoteReceiver(def_domain_interrupted)
domainsinterruptedins_2 = Domain(def_domain_interrupted_5)

# ---- group: ObjectsForDataRestoring
pulldown = CreatePulldownMenu(showLabel=False)
button_3 = CreateButton(ButtonName="Apply", ButtonStyle=0)
label_29 = CreateLabel(LabelText="Saved templates", LabelSize=12, Justification=0)
buttonapply = Data(button_3)
label_savrdtmpl = Data(label_29)
pulldownmenu_tmpl = Data(pulldown)
merge_33 = Merge(Data1=label_savrdtmpl, Data2=pulldownmenu_tmpl, Data3=buttonapply)
values_33 = ValueListener(Elements=pulldownmenu_tmpl, SomeProperty=True)  # -> Values, Indices
values_34 = ValueListener(Elements=buttonapply, SomeProperty=True)  # -> Values, Indices
adjustpos_17 = AdjustElementPositioning(ElementsToAdjust=buttonapply, AbsolutePositioning=False, Width=Slider(67, range=0..100), HorizontalAlignment=3)
adjustpos_18 = AdjustElementPositioning(ElementsToAdjust=pulldownmenu_tmpl, AbsolutePositioning=False, Width=Slider(159, range=0..1000), HorizontalAlignment=3)

# ----
stack_7 = CreateStack(UIElements=merge_33, Horizontal=True)
objectsfortmltrestoring = Data(stack_7)
data_40 = DataDescription(objectsfortmltrestoring)
selectedtemplate = Data(values_33.Values)
applytemplate = Data(values_34.Values)
elementsstore_restore = Data(data_40)

# ---- group: SetBoundaryValues(UNinterrupt)
textbox_16 = CreateTextBox(DefaultText=panel_3, UpdateButton=False, showLabel=True)
label_30 = CreateLabel(LabelText="Boundary values for uninterrupted insolation", LabelSize=12, Justification=0)
textbox_17 = CreateTextBox(UpdateButton=False, showLabel=True)
item_7 = ListItem(List=textbox_16, Index=0, Wrap=True)
values_35 = ValueListener(Elements=textbox_16, Trigger=ui_acceptdata_3, SomeProperty=False)  # -> Values, Indices
adjustpos_19 = AdjustElementPositioning(ElementsToAdjust=textbox_16, AbsolutePositioning=False, Width=Slider(33, range=0..100), HorizontalAlignment=3)
settextbox_2 = SetTextBoxContents(TextBoxToModify=textbox_17, NewTextBoxContents=ui_hoursdifference_2)

# ----
merge_34 = Merge(Data1=textbox_16, Data2=textbox_17)
merge_35 = Merge(Data1=item_7, Data2=textbox_17)

# ---- group: SetBoundaryValues(UNinterrupt) (continued)
stack_8 = CreateStack(UIElements=merge_34, Horizontal=True)
hideshow_8 = HideShowElement(ElementToHideShow=merge_35, Show=True, Collapse=False, Disable=True)
merge_36 = Merge(Data1=label_30, Data2=stack_8)  # -> flatten(Result)
stack_9 = CreateStack(UIElements=merge_36, Horizontal=False)

# ----
merge_37 = Merge(Data1=stack_9, Data2=stack_3)
data_41 = Data(merge_37)
tooltip_5 = AttachTooltipToElement(ElementsToAttachTo=data_41, TooltipContent="Hours", ShowDelay=500, Duration=2000)
data_42 = DataDescription(data_41)
expander_4 = CreateExpander(UIElements=data_42, Header="Domain settings", Open=False)
ui_fordomain_uninterrupt = RemoteSender(values_35.Values)
ui_fordomain_uninterrupt_2 = RemoteReceiver(ui_fordomain_uninterrupt)
data_43 = Data(flatten(ui_fordomain_uninterrupt_2))

merge_38 = Merge(Data1=data_43, Data2=hoursofins)
result_16 = DataDescription(merge_38)
result_17 = Result(result_16)
cull_i_8 = CullIndex(List=result_17, Indices=-1, Wrap=True)
cull_i_9 = CullIndex(List=result_17, Indices=0, Wrap=True)
dom_3 = ConstructDomain(DomainStart=cull_i_8, DomainEnd=expr("x", cull_i_9))

domainsuninterruptedins = DataDescription(dom_3)
def_domain_uninterrupted = RemoteSender(domainsuninterruptedins)
_4thexpander = Data(expander_4)
textboxes_bvunint = DataDescription(textbox_16)
def_domain_uninterrupted_2 = RemoteReceiver(def_domain_uninterrupted)

# ---- group: Store/RestoreData
textbox_floorh_2 = Data1(textbox_floorh)
textbox_floorc_2 = Data2(textbox_floorc)
textbox_windowh_2 = Data3(textbox_windowh)
textbox_windoww_2 = Data4(textbox_windoww)
textbox_setlat_2 = Data1(textbox_setlat)
textbox_setlong_2 = Data2(textbox_setlong)
textbox_timezone_2 = Data3(textbox_timezone)
slider_month_2 = Data4(slider_month)
slider_day_2 = Data5(slider_day)
textbox_hoursfrom_2 = Data6(textbox_hoursfrom)
textbox_hoursto_2 = Data7(textbox_hoursto)
textbox_timestep_2 = Data8(textbox_timestep)
textboxes_bvunint_2 = Data9(textboxes_bvunint)
textboxes_bvint_2 = Data10(textboxes_bvint)
merge_39 = Merge(
    Data1=textbox_floorh_2,
    Data2=textbox_floorc_2,
    Data3=textbox_windowh_2,
    Data4=textbox_windoww_2,
    Data5=textbox_setlat_2,
    Data6=textbox_setlong_2,
    Data7=textbox_timezone_2,
    Data8=slider_month_2,
    Data9=slider_day_2,
    Data10=textbox_hoursfrom_2,
    Data11=textbox_hoursto_2,
    Data12=textbox_timestep_2,
    Data13=textboxes_bvunint_2,
    Data14=textboxes_bvint_2)
savestates = SaveElementStates(Elements=merge_39, SaveState=savetemplate, StateName=tmplname, ClearSavedStates=clearallstates)  # -> SavedStates, SavedStateNames
restore = RestoreElementStates(Restore=applytemplate, SavedStates=savestates.SavedStates, StateNameToRestore=selectedtemplate)

# ----
_4thexpander_2 = Data(_4thexpander)
entwine_14 = Entwine(
    Branch00=elementsstore_restore,
    Branch01=_1stexpander_2,
    Branch02=_2dexpander_2,
    Branch03=_3dexpander_2,
    Branch04=_4thexpander_2,
    Branch05=buttoncalculate,
    Branch06=buttoncalculate_2,
    FlattenInputs=True)
elementstoadd = Data(entwine_14)
ui_templatename = RemoteSender(savestates.SavedStateNames)
ui_templatename_2 = RemoteReceiver(ui_templatename)

# ---- group: ObjectsForDataRestoring (continued)
setlist = SetListContents(ListToModify=pulldown, NewListContents=ui_templatename_2)

# ----
addelems_2 = AddElements(Window=launchwin_2, Elements=flatten(elementstoadd), DoVLChecking=True)  # -> AddedElements, ElementNames
def_domain_uninterrupted_3 = RemoteReceiver(def_domain_uninterrupted)

# ---- group: GetValuesColours(UNinterrupted)
dedomain_2 = DeconstructDomain(Domain=def_domain_uninterrupted_3)  # -> Start, End
data_44 = Data(dedomain_2.End)
data_45 = Data(dedomain_2.Start)
item_8 = ListItem(List=data_45, Index=-1, Wrap=True)
item_9 = ListItem(List=data_44, Index=-1, Wrap=True)
merge_40 = Merge(Data1=data_45, Data2=item_9)
subtraction_6 = Subtraction(A=item_9, B=item_8)
division_6 = Division(A=subtraction_6, B="0.5")
uninterruptedbvalues = DataDescription(merge_40)
series_2 = Series(Start=item_8, Step="0.5", Count=division_6)
data_46 = Data(def_colour_uninterrupted_3)
shift_8 = ShiftPaths(Data=series_2, Offset=-1)
tstat_2 = TreeStatistics(Tree=data_46)  # -> Paths, Length, Count
item_10 = ListItem(List=tstat_2.Paths, Index=-1, Wrap=True)
cull_i_10 = CullIndex(List=shift_8, Indices=0, Wrap=True)
split_4 = SplitTree(Data=data_46, Masks=flatten(item_10))  # -> Positive, Negative
merge_41 = Merge(Data1=shift_8, Data2=item_9)
shift_9 = ShiftPaths(Data=cull_i_10, Offset=-1)
long_2 = LongestList(ListA=shift_9, PaddingMode=2)  # -> ListA, ListB
bnd_2 = Bounds(Numbers=merge_41)
cull_i_11 = CullIndex(List=long_2.ListB, Indices=0, Wrap=True)
remap_2 = RemapNumbers(Value=merge_41, Source=bnd_2, Target=Domain(0, 1))  # -> Mapped, Clipped
shift_10 = ShiftPaths(Data=cull_i_11, Offset=-1)
interp_2 = InterpolateData(Data=split_4.Positive, Parameter=remap_2.Mapped, Interpolation=2)
merge_42 = Merge(Data1=data_45, Data2=shift_9, Data3=item_9)
merge_43 = Merge(Data1=data_45, Data2=shift_10, Data3=item_9)
shift_11 = ShiftPaths(Data=interp_2, Offset=-1)  # -> reverse(Data)
cull_i_12 = CullIndex(List=shift_11, Indices=-1, Wrap=True)
entwine_15 = Entwine(Branch0X=split_4.Negative, Branch1X=cull_i_12, FlattenInputs=False)
renumber_3 = RenumberPaths(Data=entwine_15)
tstat_3 = TreeStatistics(Tree=renumber_3)  # -> Paths, Length, Count
data_47 = Data(reverse(tstat_3.Paths))
replace = ReplacePaths(Data=renumber_3, Search=tstat_3.Paths, Replace=data_47)

# ----
uninterruptedbvalues_2 = Result(uninterruptedbvalues)
data_48 = Data(merge_43)
uninterruptedvalues = Data(merge_42)
uninterruptedcolours = Data(replace)

# ---- group: MakeGrid
merge_44 = Merge(Data1=uninterruptedvalues, Data2=interruptedvalues)
shift_12 = ShiftPaths(Data=merge_44, Offset=-1)
dcon = DeleteConsecutive(Set=shift_12, Wrap=True)  # -> Set, Count
bnd_3 = Bounds(Numbers=dcon.Set)
remap_3 = RemapNumbers(Value=dcon.Set, Source=bnd_3, Target=Domain(0, 1))  # -> Mapped, Clipped
shatter = Shatter(Curve=reparameterize(getmainlegendline), Parameters=remap_3.Mapped, UseTasks=True)  # -> graft(Segments)
offset = OffsetCurve(Curve=shatter, Distance="-30", Plane=PlaneXY(0, 0, 0), Corners=1)
shift_13 = ShiftPaths(Data=offset, Offset=-1)
merge_45 = Merge(Data1=shatter, Data2=shift_13)
loft = Loft(Curves=merge_45, Options={Adjust=False, Closed=False, LoftEnds=0, LoftSimp=0, LoftType=0, Rebuild=10, Refit=0.01})
crv = Curve(flatten(loft))
cp = ControlPoints(Curve=crv)  # -> Points, Weights, Knots
item_11 = ListItem(List=cp.Points, Index=Slider(0, range=0..10), Wrap=True)  # -> flatten(Item)
orient = Orient(Geometry=crv, Source=item_11, Target=PlaneXY(0, 0, 0))  # -> reverse(graft(Geometry)), Transform

# ----
data_49 = DataDescription(reverse(data_48))

# ---- group: SetColours
entwine_16 = Entwine(Branch0X=uninterruptedcolours, Branch1X=interruptedcolours, FlattenInputs=False)  # -> graft(Result)
colours_3 = Data(entwine_16)
colours_4 = Data(colours_3)

# ---- group: CreateTooptip
colours_5 = Data(entwine_16)
split_5 = SplitTree(Data=colours_5, Masks=flatten("{0;*}"))  # -> Positive, Negative
tstat_4 = TreeStatistics(Tree=split_5.Positive)  # -> Paths, Length, Count
tstat_5 = TreeStatistics(Tree=split_5.Negative)  # -> Paths, Length, Count
lng_2 = ListLength(List=tstat_4.Paths)
lng_3 = ListLength(List=tstat_5.Paths)
subtraction_7 = Subtraction(A=lng_2, B=3)
subtraction_8 = Subtraction(A=lng_3, B=3)
dup = DuplicateData(Data="Четко", Number=subtraction_7, Order=True)  # -> flatten(Data)
dup_2 = DuplicateData(Data="0", Number=subtraction_8, Order=True)  # -> flatten(Data)
panel_17 = Panel("""0
0
Все хуйня, давай по новой
Все хуйня, давай по новой
0
0""")
merge_46 = Merge(Data1=dup, Data2=panel_17, Data3=dup_2)

# ---- group: GetLabelContext
merge_47 = Merge(Data1=data_49, Data2=data_39)  # -> graft(Result)
valuesforlabel = Data(flatten(merge_47))
int = Integer(valuesforlabel)
int_2 = Integer("0")
mindex = MemberIndex(Set=int, Member=int_2)  # -> flatten(Index), Count

# ----
datafortooltip = Data(graft(merge_46))
shapes = Data(orient.Geometry)
legendmiddle = Data(mindex.Index)
valuesforlabel_2 = Data(merge_47)
colours_6 = Data(colours_4)

# ---- group: GetAlignmentNumber
split_6 = SplitList(List=flatten(valuesforlabel), Index=expr("x+1", legendmiddle))  # -> ListA, ListB
long_3 = LongestList(ListA="0", ListB=split_6.ListA, PaddingMode=2)  # -> ListA, ListB
long_4 = LongestList(ListA="2", ListB=split_6.ListB, PaddingMode=2)  # -> ListA, ListB
merge_48 = Merge(Data1=long_3.ListA, Data2=long_4.ListA)  # -> graft(Result)

# ----
vertalignment = Data(merge_48)

# ---- group: CreateLabels
label_31 = CreateLabel(LabelText=valuesforlabel_2, LabelSize=12, Justification=0)
adjustpos_20 = AdjustElementPositioning(
    ElementsToAdjust=label_31,
    AbsolutePositioning=False,
    Width=Slider(67, range=0..100),
    HorizontalAlignment=3,
    VerticalAlignment=vertalignment)

# ---- group: CreateShapes
shapes_2 = CreateShapes(Shapes=shapes, FillColor=colours_6, StrokeColor=RGBA(0, 0, 0, 0), Scale=0.9, ClickMode=3)
adjustpos_21 = AdjustElementPositioning(ElementsToAdjust=shapes_2, AbsolutePositioning=False, HorizontalAlignment=3, VerticalAlignment=vertalignment)
tooltip_6 = AttachTooltipToElement(ElementsToAttachTo=shapes_2, TooltipContent=datafortooltip, ShowDelay=500, Duration=2000)

# ---- group: MakeGrid
weave = Weave(Pattern=[0, 1], Stream0=label_31, Stream1=shapes_2, NullGaps=False)
renumber_4 = RenumberPaths(Data=weave)
flip_7 = FlipMatrix(Data=renumber_4)
simplegrid_9 = CreateSimpleGrid(UIElements=flip_7, RowDefinitions="Auto", ColumnDefinitions="Auto")

# ----
legendgrid = Data(simplegrid_9)
entwine_17 = Entwine(
    Branch00=label_legend_2,
    Branch01=label_uninterrupted_2,
    Branch02=legendgrid,
    Branch03=label_interrupted_2,
    FlattenInputs=True)
elementsoflegend = Data(entwine_17)
def_domain_uninterrupted_4 = RemoteReceiver(def_domain_uninterrupted)  # disabled
addelems_3 = AddElements(Window=window_legend_2, Elements=flatten(elementsoflegend), DoVLChecking=True)  # -> AddedElements, ElementNames
remote_receiver_2 = DataDescription(def_domain_uninterrupted_4)  # disabled
def_domain_uninterrupted_5 = RemoteReceiver(def_domain_uninterrupted)
domainsuninterruptedins_2 = Domain(def_domain_uninterrupted_5)
entwine_18 = Entwine(
    Branch0X=domainsuninterruptedins_2,
    Branch1X=domainsuninterruptedins_2,
    Branch2X=domainsinterruptedins_2,
    FlattenInputs=False)
shift_14 = ShiftPaths(Data=entwine_18, Offset=-2)
domains = DataDescription(shift_14)
domains_2 = Data(domains)

# ----
# add floor if (v-max floor>1.5)
item_12 = ListItem(List=list_a, Index=-1, Wrap=True)
subtraction_9 = Subtraction(A=data_19, B=item_12)
smaller_3 = SmallerThan(FirstNumber=subtraction_9, SecondNumber=1.5)  # -> SmallerThan, OrEqualTo
dispatch_8 = Dispatch(List=subtraction_9, DispatchPattern=smaller_3.SmallerThan)  # -> ListA, ListB
clean_6 = CleanTree(RemoveNulls=True, RemoveInvalid=True, RemoveEmpty=True, Tree=dispatch_8.ListB)
filter_unmatched = FilterUnmatched(Data0=item_12, Data1=clean_6)  # -> Data0, Data1
addition = Addition(A=filter_unmatched.Data0, B=filter_unmatched.Data1)
result_18 = DataDescription(addition)
data_50 = Data(list_a)

# ----
# DivideSrf/OrientPanels
clean_7 = CleanTree(RemoveNulls=True, RemoveInvalid=True, RemoveEmpty=True, Tree=result_18)

merge_49 = Merge(Data1=data_50, Data2=clean_7)

result_19 = DataDescription(merge_49)

# ----
# divide surface
range = Range(Domain=Domain(0, 1), Steps=graft(data_30))
remap_4 = RemapNumbers(Value=result_19, Source=data_31, Target=Domain(0, 1))  # -> Mapped, Clipped
toggle_9 = BooleanToggle(False)
consec = ConsecutiveDomains(Numbers=range, Additive=toggle_9)
consec_2 = ConsecutiveDomains(Numbers=remap_4.Mapped, Additive=toggle_9)
crossref = CrossReference(ListA=consec, ListB=consec_2, CrossMode=1)  # -> ListA, ListB
dedomain_3 = DeconstructDomain(Domain=crossref.ListA)  # -> Start, End
dedomain_4 = DeconstructDomain(Domain=crossref.ListB)  # -> Start, End
dom²num = ConstructDomain²(UMin=dedomain_3.Start, UMax=dedomain_3.End, VMin=dedomain_4.Start, VMax=dedomain_4.End)
shift_15 = ShiftPaths(Data=dom²num, Offset=-1)
data_51 = Data(data_29)
subsrf = Isotrim(Surface=graft(data_51), Domain=shift_15)
clean_8 = CleanTree(RemoveNulls=True, RemoveInvalid=True, RemoveEmpty=True, Tree=subsrf)

tree_6 = DataDescription(clean_8)

# ----
# flip surface normal
flip_8 = Flip(Surface=tree_6, Guide=tree_5)  # -> Surface, Result
surface = DataDescription(flip_8.Surface)
evalsrf_4 = EvaluateSurface(Surface=reparameterize(surface), Point=".5, .5")  # -> Point, Normal, UDirection, VDirection, Frame
move_3 = Move(Geometry=evalsrf_4.Frame, Motion=expr("x*0.1", evalsrf_4.Normal))  # -> Geometry, Transform

data_52 = Data(move_3.Geometry)  # disabled
vdis = VectorDisplay(Anchor=evalsrf_4.Point, Vector=evalsrf_4.Normal)
c_script_2 = CSharpScript(x=number_slider_2, y=number_slider_3, z=data_52)  # -> out, A; inputs x: Double, y: Double, z: tree of Plane; disabled
# ---------- c_script_2: C# ----------
    Panel p = new Panel(x, y);
    var path = z.Paths;
    var l = z.Branches;
    List <Mesh> meshes = new List <Mesh>();
    List <Plane> lists = new List  <Plane>();



    for (int i = 0; i < path.Count; i++)
    {
      var lp = l[i];

      //List<Plane> ss = new List<Plane>();
      // lists.Add(ss);
      for (int j = 0; j < lp.Count; i++)
      {
        Plane a = lp[j];

        lists.Add(a);
      }
    }
    // Transform t = Transform.PlaneToPlane(Plane.WorldXY, lp[j]);
    //           p.Mesh.Transform(t);
    //          meshes.Add(p.Mesh);
    //       }
    //      }



    //Transform t = Transform.PlaneToPlane(Plane.WorldXY, z);

    //p.Mesh.Transform(t);

    A = lists;
# ---------- c_script_2: C# additional code ----------
  public class Panel
  {
    public Mesh Mesh;

    public Panel(double x, double y)
    {
      Interval a = new Interval (-x / 2, x / 2);
      Interval b = new Interval (-y / 2, y / 2);

      Rectangle3d w = new Rectangle3d(Plane.WorldXY, a, b);
      Curve r = w.ToNurbsCurve();
      var p = new MeshingParameters(1);

      Mesh s = Mesh.CreateFromPlanarBoundary(r, p, 1);
      Mesh = s;
    }
  }
# ---------- end c_script_2 ----------
c_script_3 = CSharpScript(x=number_slider_2, y=number_slider_3, z=data_52)  # -> out, A; inputs x: Double, y: Double, z: tree of Plane; disabled
# ---------- c_script_3: C# ----------
    Panel p = new Panel(x, y);
    var path = z.Paths;
    var l = z.Branches;
    List <Mesh> meshes = new List <Mesh>();
    List <Plane> lists = new List  <Plane>();


    System.Console.Write(lists);
    for (int i = 0; i < path.Count; i++)
    {
      var lp = l[i];
      lists.Add(lp);
    }
    /*
    List<Plane> ss = new List<Plane>();
     lists.Add(ss);
         for (int j = 0; j < lp.Count; i++)
         {
           Plane a = lp[j];
    
           lists.Add(a);
        }
      }
     Transform t = Transform.PlaneToPlane(Plane.WorldXY, lp[j]);
               p.Mesh.Transform(t);
              meshes.Add(p.Mesh);
           }
          }
*/


    //Transform t = Transform.PlaneToPlane(Plane.WorldXY, z);

    //p.Mesh.Transform(t);

    A = lists;
# ---------- c_script_3: C# additional code ----------
  public class Panel
  {
    public Mesh Mesh;

    public Panel(double x, double y)
    {
      Interval a = new Interval (-x / 2, x / 2);
      Interval b = new Interval (-y / 2, y / 2);

      Rectangle3d w = new Rectangle3d(Plane.WorldXY, a, b);
      Curve r = w.ToNurbsCurve();
      var p = new MeshingParameters(1);

      Mesh s = Mesh.CreateFromPlanarBoundary(r, p, 1);
      Mesh = s;
    }
  }
# ---------- end c_script_3 ----------
c_script_4 = CSharpScript(x=number_slider_2, y=number_slider_3, z=data_52)  # -> A; inputs x: Double, y: Double, z: tree of Plane; disabled; same code as c_script_2

# ----
# create panels
c_script_5 = CSharpScript(x=number_slider_4, y=number_slider_5, p=xy)  # -> out, A; inputs x: Double, y: Double, p: Plane
# ---------- c_script_5: C# ----------
  


    Interval a = new Interval (-x / 2, x / 2);
    Interval b = new Interval (-y / 2, y / 2);
    Rectangle3d r = new Rectangle3d (p, a, b);
    A = r;
# ---------- end c_script_5 ----------
orient_2 = Orient(Geometry=c_script_5.A, Source=xy, Target=move_3.Geometry)  # -> Geometry, Transform
cp_2 = ControlPoints(Curve=orient_2.Geometry)  # -> Points, Weights, Knots
cull_i_13 = CullIndex(List=cp_2.Points, Indices=-1, Wrap=True)
shift_16 = ShiftPaths(Data=cull_i_13, Offset=-1)
conmesh = ConstructMesh(Vertices=shift_16, Faces={A=0, B=1, C=2, D=3})
shift_17 = ShiftPaths(Data=conmesh, Offset="-3")  # -> graft(Data)

mesh_2 = DataDescription(shift_17)

# ----
# INPUT
windowssurfaces = Data(mesh_2)
geometry_3 = Data(geometry_2)
context_3 = Data(context_2)

context_4 = Context(context_3)
geometry_4 = Geometry(geometry_3)
guidegeometry = Data(windowssurfaces)
geometry_5 = RemoteSender(geometry_4)
context_5 = RemoteSender(context_4)
context_6 = Context(context_4)
geometry_6 = Geometry(geometry_4)
merge_50 = Merge(Data1=context_6, Data2=geometry_6)
result_20 = Result(merge_50)

# ----
# PresizedData
# Location Settings
# Period Settings
constructlocation = Ladybug_ConstructLocation(locationName="unknown_Location", latitude=ui_latitude_2, longitude=ui_longitude_2, timeZone=ui_time_zone_2, elevation=0)  # -> location; plug-in component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
analysisperiod = Ladybug_AnalysisPeriod(
    fromMonth=ui_month_2,
    fromDay=ui_day_2,
    fromHour=ui_hours_from_3,
    toMonth=ui_month_2,
    toDay=ui_day_2,
    toHour=ui_hours_to_3)  # -> readMe, analysisPeriod; plug-in component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
location = DataDescription(constructlocation)
analysisperiod_2 = DataDescription(analysisperiod.analysisPeriod)
sunpath = Ladybug_SunPath(
    location=location,
    hour=12,
    day=21,
    month=12,
    timeStep=division_3,
    analysisPeriod=analysisperiod_2,
    dailyOrAnnualSunPath=True)  # -> readMe, sunVectors, sunAltitudes, sunAzimuths, port, sunSpheresMesh, sunPathCrvs, compassCrvs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; plug-in component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
data_53 = Data(sunpath.sunSpheresMesh)
data_54 = Data(sunpath.sunPathCrvs)
data_55 = Data(sunpath.compassCrvs)
geo_sunspheresmesh = RemoteSender(data_53)
geo_compasscrvs = RemoteSender(data_55)
geo_pathcrvs = RemoteSender(data_54)
sunvectors = Data(sunpath.sunVectors)
ui_calculatebutton_3 = RemoteReceiver(ui_calculatebutton)
geometry_7 = AGDataDescription(windowssurfaces)
result_21 = Result(result_20)
bool = Boolean(ui_calculatebutton_3)
sunlighthoursanalysis = Ladybug_SunlightHoursAnalysis(
    geometry=flatten(geometry_7),
    context=flatten(result_21),
    gridSize=5,
    disFromBase=0.001,
    sunVectors=flatten(sunvectors),
    timeStep=result_7,
    parallel=Toggle(True),
    runIt=bool)  # -> readMe, contextMesh, analysisMesh, testPts, testVec, port, sunlightHoursResult, sunlightHoursMesh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; plug-in component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

lb_period = RemoteSender(analysisperiod_2)
lb_location = RemoteSender(location)
sunvisible = Data(sunlighthoursanalysis.sunIsVisible)
geometry_8 = _geometry(geometry_7)  # disabled
renumber_5 = RenumberPaths(Data=geometry_8)  # disabled
sunvisible_2 = SunVisible(sunvisible)
geometry_9 = _geometry(renumber_5)  # disabled
sunvisible_3 = Data(sunvisible_2)  # disabled
shift_18 = ShiftPaths(Data=sunvisible_3, Offset=-1)  # disabled

# ----
# RewriteResultsByRelevantNorms
# PythonScript
isinterrupted = Ladybug_sunlightHoursUACIS(timeStep=result_10, geometry=geometry_9, sunIsVisible=shift_18, timeUninterrupted=number_slider_7)  # -> readMe, analysisMesh, sunlightHoursResult, isInterrupted; disabled; plug-in component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

renumber_6 = RenumberPaths(Data=isinterrupted.sunlightHoursResult)  # disabled
out = DataDescription(isinterrupted.readMe)  # disabled
analysismesh = DataDescription(isinterrupted.analysisMesh)  # disabled
sunlighthoursresult = DataDescription(renumber_6)  # disabled
isinterrupted_2 = DataDescription(isinterrupted.isInterrupted)  # disabled

entwine_19 = Entwine(Branch00=remote_receiver_2, Branch01=remote_receiver, FlattenInputs=True)  # disabled
entwine_20 = Entwine(Branch0X=renumbered_data_3, Branch1X=renumbered_data_4, FlattenInputs=False)  # disabled
result_22 = DataDescription(entwine_19)  # disabled
result_23 = DataDescription(entwine_20)  # disabled
wrap = WrapList(Data=result_23)  # disabled
result_24 = Result(result_22)  # disabled
shift_19 = ShiftPaths(Data=result_24, Offset=1)  # disabled
shift_20 = ShiftPaths(Data=wrap, Offset=-1)  # disabled
analysismesh_2 = AnalysisMesh(analysismesh)  # disabled
sunlighthoursresult_2 = SunlightHoursResult(sunlighthoursresult)  # disabled
isinterrupted_3 = IsInterrupted(isinterrupted_2)  # disabled
int_3 = Integer(isinterrupted_3)  # disabled
path = ConstructPath(Indices=int_3)  # disabled
branch = TreeBranch(Tree=shift_19, Path=path, MaintainPaths=False)  # disabled
branch_2 = TreeBranch(Tree=shift_20, Path=path, MaintainPaths=False)  # disabled
inc_2 = Includes(Value=sunlighthoursresult_2, Domain=branch)  # -> Includes, Deviation; disabled
toggle_10 = BooleanToggle(True)  # disabled
mindex_2 = MemberIndex(Set=inc_2.Includes, Member=toggle_10)  # -> Index, Count; disabled
item_13 = ListItem(List=mindex_2.Index, Index=0, Wrap=True)  # disabled
item_14 = ListItem(List=mindex_2.Index, Index=0, Wrap=True)  # disabled
item_15 = ListItem(List=branch, Index=item_13, Wrap=True)  # disabled
item_16 = ListItem(List=branch_2, Index=item_14, Wrap=True)  # disabled
unwrap = UnwrapList(WrappedData=item_16)  # disabled
remap_5 = RemapNumbers(Value=sunlighthoursresult_2, Source=item_15, Target=Domain(0, 1))  # -> Mapped, Clipped; disabled
interp_3 = InterpolateData(Data=unwrap, Parameter=remap_5.Mapped, Interpolation=2)  # disabled
mcol = MeshColours(Mesh=analysismesh_2, Colours=interp_3)  # disabled

data_56 = DataDescription(guidegeometry)
guidegeometry_2 = Data(data_56)
sunvisible_4 = SunVisible(sunvisible_2)

# ---- group: FindInsTime/SortMeshes
# GrasshopperScript
shift_21 = ShiftPaths(Data=sunvisible_4, Offset=-1)
tstat_6 = TreeStatistics(Tree=shift_21)  # -> Paths, Length, Count
tstat_7 = TreeStatistics(Tree=guidegeometry_2)  # -> Paths, Length, Count
replace_2 = ReplacePaths(Data=shift_21, Search=tstat_6.Paths, Replace=tstat_7.Paths)
sunvisible_5 = SunVisible(replace_2)
data_57 = DataDescription(guidegeometry_2)
sunvisible_6 = SunVisible(sunvisible_5)
result_25 = TimeStep(result_11)
cull_i_14 = CullIndex(List=sunvisible_5, Indices=-1, Wrap=True)
cull_i_15 = CullIndex(List=sunvisible_5, Indices=0, Wrap=True)
shift_22 = ShiftPaths(Data=cull_i_14, Offset=-1)
shift_23 = ShiftPaths(Data=cull_i_15, Offset=-1)
merge_51 = Merge(Data1=graft(shift_22), Data2=graft(shift_23))
ma_2 = MassAddition(Input=merge_51)  # -> Result, PartialResults
int_4 = Integer(ma_2.Result)
int_5 = Integer("1")
mindex_3 = MemberIndex(Set=int_4, Member=int_5)  # -> Index, Count
clean_9 = CleanTree(RemoveNulls=True, RemoveInvalid=True, RemoveEmpty=True, Tree=mindex_3.Index)
shift_24 = ShiftPaths(Data=clean_9, Offset=-1)
tstat_8 = TreeStatistics(Tree=shift_24)  # -> Paths, Length, Count
dpath = DeconstructPath(Branch=tstat_8.Paths)
lng_4 = ListLength(List=dpath)  # -> expr("x-1", Length)
split_7 = SplitList(List=dpath, Index=lng_4)  # -> ListA, ListB
path_2 = ConstructPath(Indices=split_7.ListA)  # -> flatten(Branch)
clone = CloneStructure(List=flatten(split_7.ListB), Structure=flatten(path_2))
branch_3 = DataDescription(path_2)
branch_4 = Branch(branch_3)
int_6 = Integer(clone)
int_7 = Integer("0")
split_8 = SplitTree(Data=data_57, Masks=flatten(branch_4))  # -> Positive, Negative
split_9 = SplitTree(Data=sunvisible_6, Masks=flatten(branch_4))  # -> Positive, Negative
mindex_4 = MemberIndex(Set=int_6, Member=int_7)  # -> Index, Count
int_8 = Integer("1")
interruptedrays = DataDescription(split_9.Positive)
result_26 = TimeStep(result_25)
interruptedmeshes = DataDescription(split_8.Positive)
replace_3 = ReplaceItems(List=int_6, Item=int_8, Indices=mindex_4.Index, Wrap=False)
addition_2 = Addition(A=clone, B=1)
addition_3 = Addition(A=clone, B=1)
shift_25 = ShiftPaths(Data=replace_3, Offset=-2)
lng_5 = ListLength(List=interruptedrays)  # -> expr("x", Length)
ins_2 = InsertItems(List=addition_2, Item=0, Indices=0, Wrap=True)
ins_3 = InsertItems(List=addition_3, Item=lng_5, Indices=-1, Wrap=True)
dcon_2 = DeleteConsecutive(Set=ins_2, Wrap=False)  # -> Set, Count
dcon_3 = DeleteConsecutive(Set=ins_3, Wrap=False)  # -> Set, Count
subtraction_10 = Subtraction(A=dcon_3.Set, B=dcon_2.Set)
dcon_4 = DeleteConsecutive(Set=interruptedrays, Wrap=False)  # -> Set, Count
dispatch_9 = Dispatch(List=subtraction_10, DispatchPattern=dcon_4.Set)  # -> ListA, ListB
shift_26 = ShiftPaths(Data=dispatch_9.ListA, Offset=-2)
int_9 = Integer("1")
fullmesh = DataDescription(split_8.Negative)
fullrays = DataDescription(split_9.Negative)
lng_6 = ListLength(List=shift_26)
mindex_5 = MemberIndex(Set=fullrays, Member=int_9)  # -> Index, Count
int_10 = Integer("1")
mindex_6 = MemberIndex(Set=flatten(lng_6), Member=int_10)  # -> Index, Count
tstat_9 = TreeStatistics(Tree=shift_26)  # -> Paths, Length, Count
item_17 = ListItem(List=tstat_9.Paths, Index=mindex_6.Index, Wrap=True)
interruptedmeshes_2 = Positive(interruptedmeshes)
data_58 = DataDescription(shift_26)
masks = DataDescription(item_17)
split_10 = SplitTree(Data=data_58, Masks=flatten(masks))  # -> Positive, Negative
split_11 = SplitTree(Data=interruptedmeshes_2, Masks=flatten(masks))  # -> Positive, Negative
fullmesh_2 = FullMesh(fullmesh)
fullrays_2 = FullRays(mindex_5.Count)
directmesh = DataDescription(split_11.Positive)
directrays = DataDescription(split_10.Positive)
interruptedmesh = DataDescription(split_11.Negative)
interruptedrays_2 = DataDescription(split_10.Negative)
shift_27 = ShiftList(List=interruptedrays_2, Shift=-1, Wrap=False)
shift_28 = ShiftList(List=interruptedrays_2, Shift=1, Wrap=False)
addition_4 = Addition(A=shift_27, B=shift_28)
bnd_4 = Bounds(Numbers=addition_4)
dedomain_5 = DeconstructDomain(Domain=bnd_4)  # -> Start, End
shift_29 = ShiftPaths(Data=dedomain_5.End, Offset=-1)
fullmesh_3 = FullMesh(fullmesh_2)
result_27 = TimeStep(result_26)
fullrays_3 = FullRays(fullrays_2)
directmesh_2 = DirectMesh(directmesh)
directrays_2 = DirectRays(directrays)
interruptedmesh_2 = Negative(interruptedmesh)
interruptedrays_3 = DataDescription(shift_29)
entwine_21 = Entwine(Branch0X=fullmesh_3, Branch1X=directmesh_2, Branch2X=interruptedmesh_2, FlattenInputs=False)
entwine_22 = Entwine(Branch0X=fullrays_3, Branch1X=directrays_2, Branch2X=interruptedrays_3, FlattenInputs=False)
mesh_3 = DataDescription(entwine_21)
rays = DataDescription(entwine_22)
result_28 = TimeStep(result_27)
division_7 = Division(A=rays, B=result_28)

# ----
mesh_4 = DataDescription(mcol)  # disabled
geo_coloredmeshes_python = RemoteSender(mesh_4)  # disabled
mesh_5 = Mesh(mesh_3)
time = Rays(division_7)
time_2 = Rays(time)
mesh_6 = Mesh(mesh_5)

# ---- group: SortTime/Meshes(Includes/Not)
wrap_2 = WrapList(Data=domains_2)
shift_30 = ShiftPaths(Data=time_2, Offset=-2)
time_3 = Time(time_2)
long_5 = LongestList(ListA=shift_30, ListB=wrap_2, PaddingMode=2)  # -> ListA, ListB
unflatten = UnflattenTree(Tree=long_5.ListB, Guide=time_2)
unwrap_2 = UnwrapList(WrappedData=unflatten)
inc_3 = Includes(Value=time_2, Domain=unwrap_2)  # -> Includes, Deviation
time_4 = Time(time_3)
bool_2 = Boolean("True")
tstat_10 = TreeStatistics(Tree=time_4)  # -> Paths, Length, Count
mindex_7 = MemberIndex(Set=inc_3.Includes, Member=bool_2)  # -> Index, Count
time_5 = Time(time_4)
mesh_7 = Mesh(mesh_6)
dpath_2 = DeconstructPath(Branch=tstat_10.Paths)
item_18 = ListItem(List=mindex_7.Index, Index=-1, Wrap=True)
shift_31 = ShiftList(List=dpath_2, Shift=1, Wrap=True)
renumber_7 = RenumberPaths(Data=shift_31)
renumber_8 = RenumberPaths(Data=item_18)
merge_52 = Merge(Data1=renumber_7, Data2=renumber_8)
path_3 = ConstructPath(Indices=merge_52)
clone_2 = CloneStructure(List=flatten(mesh_7), Structure=flatten(path_3))
clone_3 = CloneStructure(List=flatten(time_5), Structure=flatten(path_3))

# ----
meshes = DataDescription(clone_2)
time_6 = DataDescription(clone_3)
time_7 = Tree(time_6)

shift_32 = ShiftPaths(Data=time_7, Offset=2)
data_59 = Data(shift_32)
split_12 = SplitTree(Data=data_59, Masks=flatten("{0;*}"))  # -> Positive, Negative
positive = DataDescription(split_12.Positive)
negative = DataDescription(split_12.Negative)
item_19 = ListItem(List=positive, Index=0, Wrap=True)
tstat_11 = TreeStatistics(Tree=item_19)  # -> Paths, Length, Count
shift_33 = ShiftList(List=tstat_11.Paths, Shift=1, Wrap=True)
replace_4 = ReplacePaths(Data=item_19, Search=tstat_11.Paths, Replace=shift_33)
merge_53 = Merge(Data1=negative, Data2=replace_4, Data3=positive)
bnd_5 = Bounds(Numbers=merge_53)
remap_6 = RemapNumbers(Value=shift_32, Source=bnd_5, Target=Domain(0, 1))  # -> Mapped, Clipped
tstat_12 = TreeStatistics(Tree=remap_6.Mapped)  # -> Paths, Length, Count
meshes_2 = Tree(meshes)
split_13 = SplitTree(Data=colours_2, Masks=flatten(tstat_12.Paths))  # -> Positive, Negative
shift_34 = ShiftPaths(Data=meshes_2, Offset=2)
interp_4 = InterpolateData(Data=split_13.Positive, Parameter=remap_6.Mapped, Interpolation=2)
mcol_2 = MeshColours(Mesh=graft(shift_34), Colours=graft(interp_4))

meshes_resorted = Data(meshes_2)
coloredmeshes = DataDescription(mcol_2)
time_8 = Time(time_7)
geo_coloredmeshes = RemoteSender(coloredmeshes)
coloredmeshes_2 = ColoredMeshes(coloredmeshes)
meshes_3 = Tree(meshes_resorted)

ctrlclickm = CtrlClickableMesh(Enable=True, Meshes=flatten(coloredmeshes_2))  # -> SelectedMeshes, SelectedIndices, MouseLine
# ManipulationsWithResults(Analysis)
tstat_13 = TreeStatistics(Tree=meshes_3)  # -> Paths, Length, Count
clone_4 = CloneStructure(List=tstat_13.Paths, Structure=tstat_13.Paths)
shift_35 = ShiftPaths(Data=clone_4, Offset=2)
index = DataDescription(ctrlclickm.SelectedIndices)
item_20 = ListItem(List=flatten(shift_35), Index=index, Wrap=True)
data_60 = Data(ctrlclickm.SelectedMeshes)
dpath_3 = DeconstructPath(Branch=item_20)
area = Area(Geometry=data_60)  # -> Area, Centroid
mesh_8 = Mesh(data_60)
item_21 = ListItem(List=dpath_3, Index=0, Wrap=True)
path_4 = ConstructPath(Indices=item_21)
facen = FaceNormals(Mesh=mesh_8)  # -> Centers, expr("x*.1", Normals)
move_4 = Move(Geometry=area.Centroid, Motion=facen.Normals)  # -> Geometry, Transform

selectedmesh_brunch = Data(item_20)
selectedbuilding = DataDescription(path_4)
centrpnt = DataDescription(move_4.Geometry)
lb_location_2 = RemoteReceiver(lb_location)
lb_period_2 = RemoteReceiver(lb_period)
sunpath_2 = Ladybug_SunPath(
    location=lb_location_2,
    hour=12,
    day=21,
    month=12,
    timeStep=result_12,
    analysisPeriod=lb_period_2,
    dailyOrAnnualSunPath=True)  # -> readMe, sunVectors, sunAltitudes, sunAzimuths, port, sunSpheresMesh, sunPathCrvs, compassCrvs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; plug-in component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
context_geometry = Data(result_20)
geometry_10 = Geometry(graft(geometry_6))
selectedbuilding_2 = SelectedBuilding(selectedbuilding)
selectedmesh_brunch_2 = Data(selectedmesh_brunch)
centrpnt_2 = Geometry(centrpnt)
time_9 = Data(time_8)
sunvectors_2 = SunVectors(sunpath_2.sunVectors)
geometry_11 = Geometry(geometry_10)
sunvectors_3 = SunVectors(sunvectors_2)
data_61 = DataDescription(context_geometry)
centrpnt_3 = CentrPnt(centrpnt_2)
time_10 = Data(time_9)
data_62 = Data(selectedmesh_brunch_2)

rev = Reverse(Vector=sunvectors_3)
vector = DataDescription(rev)
centrpnt_4 = CentrPnt(centrpnt_3)
line = LineSDL(Start=centrpnt_4, Direction=vector, Length=200)
mesh_9 = MeshBrep(
    Brep=data_61,
    Settings={GridMaxCount=0, GridMinCount=16, JaggedSeams=False, MaxEdgeLength=0, MinEdgeLength=0.0001, MinTolerance=0, Refine=True, RefineAngle=0, RelativeTolerance=0.65, SimplePlanes=True, Tolerance=0})
allsunrays = Data(line)
mjoin_2 = MeshJoin(Meshes=mesh_9)
meshray = MeshRay(Mesh=mjoin_2, Point=centrpnt_4, Direction=allsunrays)  # -> Point, Hit
allsunrays_2 = Data(allsunrays)
loft_2 = Loft(Curves=allsunrays_2, Options={Adjust=False, Closed=False, LoftEnds=0, LoftSimp=0, LoftType=0, Rebuild=10, Refit=0.01})
dispatch_10 = Dispatch(List=allsunrays, DispatchPattern=meshray.Hit)  # -> ListA, ListB

# ---- group: InsolatedPanelPercentage(Site)
path_mapper_3 = PathMapper(time_10, source="{A;B;C;D}", target="{A;C;D}")
data_63 = Data(path_mapper_3)
split_14 = SplitTree(Data=data_63, Masks=flatten("{*;3}"))  # -> Positive, Negative
data_64 = Data(flatten(split_14.Positive))
data_65 = Data(flatten(data_63))
lng_7 = ListLength(List=data_64)
multiplication_5 = Multiplication(A=lng_7, B=100)
lng_8 = ListLength(List=data_65)
division_8 = Division(A=multiplication_5, B=lng_8)
expression = Expression(x=division_8, Expression="Round(x,2)")

# ----
allsunrays_3 = DataDescription(meshray.Hit)
loft_3 = DataDescription(loft_2)
passedrays = DataDescription(dispatch_10.ListB)
percentageofinspanels_site = Data(expression)
passedrays_2 = PassedRays(passedrays)
geometry_12 = Geometry(geometry_11)
intersectionpattern = Data(allsunrays_3)
def_percentageofinspanels_site = RemoteSender(percentageofinspanels_site)
def_percentageofinspanels_site_2 = RemoteReceiver(def_percentageofinspanels_site)
concat = Concatenate(FragmentA=def_percentageofinspanels_site_2, FragmentB=" %")

intersectionpattern_2 = Data(intersectionpattern)
passedrays_3 = ListB(passedrays_2)
int_11 = Integer(intersectionpattern_2)
shift_36 = ShiftList(List=int_11, Shift=1, Wrap=False)
equals_3 = Equality(FirstNumber=int_11, SecondNumber=shift_36)  # -> Equality, Inequality
shift_37 = ShiftList(List=equals_3.Inequality, Shift=-1, Wrap=True)
lng_9 = ListLength(List=equals_3.Inequality)
bool_3 = Boolean("1")
mindex_8 = MemberIndex(Set=shift_37, Member=bool_3)  # -> Index, Count
ins_4 = InsertItems(List=mindex_8.Index, Item=0, Indices=0, Wrap=True)
ins_5 = InsertItems(List=mindex_8.Index, Item=lng_9, Indices=-1, Wrap=True)
dcon_5 = DeleteConsecutive(Set=intersectionpattern_2, Wrap=False)  # -> Set, Count
subtraction_11 = Subtraction(A=ins_5, B=ins_4)
dispatch_11 = Dispatch(List=subtraction_11, DispatchPattern=dcon_5.Set)  # -> ListA, ListB

intersectionpattern_3 = Data(intersectionpattern)
int_12 = Integer(intersectionpattern_3)
cset = CreateSet(List=int_12)  # -> Set, Map
lng_10 = ListLength(List=cset.Set)
expression_2 = Expression(x=lng_10, y=cset.Set, Expression="if(x=2,0,if((x=1)and(y=0),1,if((x=1)and(y=1),2,3)))")
cset_2 = CreateSet(List=expression_2)  # -> Set, Map
lng_11 = ListLength(List=intersectionpattern_3)

geometry_13 = Geometry(geometry_12)
gate_max_passedrays_zero = Data(cset_2.Set)
maxvalue = DataDescription(lng_11)
passedchunks = Data(dispatch_11.ListB)
passedrays_4 = PassedRays(passedrays_3)
gate_max_passedrays_zero_2 = DataDescription(gate_max_passedrays_zero)
allchunks = DataDescription(passedchunks)
maxvalue_2 = MaxValue(maxvalue)
filter_2 = StreamFilter(Gate=gate_max_passedrays_zero_2, Stream0=allchunks, Stream1=maxvalue_2, Stream2=zero)
partition = PartitionList(List=passedrays_4, Size=filter_2)
ma_3 = MassAddition(Input=filter_2)  # -> Result, PartialResults
loft_4 = Loft(Curves=partition, Options={Adjust=False, Closed=False, LoftEnds=0, LoftSimp=0, LoftType=0, Rebuild=10, Refit=0.01})
time_11 = ConstructTime(Hour=0, Minute=ma_3.Result, Second=0)
ddate = DeconstructDate(Date=time_11)  # -> Year, Month, Day, Hour, Minute, Second
rays_2 = Data(loft_4)
expression_3 = Expression(x=ddate.Minute, Expression="Format(\"{0:00}\",x)")
expression_4 = Expression(x=ddate.Hour, Expression="Format(\"{0:00}\",x)")
concat_2 = Concatenate(FragmentA=expression_4, FragmentB=":", FragmentC=expression_3)
selectedbuilding_3 = SelectedBuilding(selectedbuilding_2)
def_insolationtime_selectedpanel_detaile = RemoteSender(concat_2)  # "DEF_InsolationTime(SelectedPanel(Detailed))"
def_insolationtime_selectedpanel_detaile_2 = RemoteReceiver(def_insolationtime_selectedpanel_detaile)  # "DEF_InsolationTime(SelectedPanel(Detailed))"

# ---- group: Values(Percentage/Time)
label_32 = CreateLabel(LabelSize=24, Justification=0)
label_percentage_timevalue = Data(label_32)
simplegrid_10 = CreateSimpleGrid(UIElements=label_percentage_timevalue, Width=Slider(398, range=0..600), RowDefinitions="Auto", ColumnDefinitions="Auto")
adjustpos_22 = AdjustElementPositioning(
    ElementsToAdjust=label_32,
    Margin="135,20,100,10",
    AbsolutePositioning=False,
    Width=Slider(398, range=0..600),
    Height=Slider(54, range=0..100),
    HorizontalAlignment=3,
    VerticalAlignment=3)
analysistrigger_2 = Data(ui_toggle_analysis_2)
filter_3 = StreamFilter(Gate=analysistrigger_2, Stream0=concat, Stream1=def_insolationtime_selectedpanel_detaile_2)
setlabel_3 = SetLabelContents(LabelToModify=label_32, NewLabelContents=filter_3)
adjustelem_9 = AdjustElementAppearance(
    ElementsToAdjust=simplegrid_10,
    Foreground=ColourSwatch(SwatchColor=RGB(255, 255, 255)),
    Background=ColourSwatch(SwatchColor=RGB(137, 158, 130)),
    FontSize=35)
tooltip_7 = AttachTooltipToElement(
    ElementsToAttachTo=simplegrid_10,
    TooltipContent="Select panel (Ctrl + Left Click on panel)",
    ShowDelay=500,
    Duration=10000)

# ----
shapeui = Data(simplegrid_10)
shapeui_2 = DataDescription(shapeui)
geo_insolationhours = RemoteSender(filter_2)
geo_sunrays = RemoteSender(rays_2)
geometry_14 = Data(geometry_13)
selectedbuilding_4 = SelectedBuilding(selectedbuilding_3)
shift_38 = ShiftPaths(Data=geometry_14, Offset=1)
split_15 = SplitTree(Data=shift_38, Masks=flatten(selectedbuilding_4))  # -> Positive, Negative
buildings_withoutselected = DataDescription(split_15.Negative)
loft_5 = Loft(loft_3)
extr = Extrude(Base=loft_5, Direction=Z_2)
buildings_withoutselected_2 = BuildingsWithoutSelected(buildings_withoutselected)

long_6 = LongestList(ListA=extr, ListB=buildings_withoutselected_2, PaddingMode=2)  # -> ListA, ListB
sint = SolidIntersection(BrepsA=graft(long_6.ListB), BrepsB=graft(long_6.ListA))
cuttedvolumes = Data(sint)

geo_cuttedvolumes = RemoteSender(cuttedvolumes)
geo_coloredmeshes_python_2 = RemoteReceiver(geo_coloredmeshes_python)
geo_sunspheresmesh_2 = RemoteReceiver(geo_sunspheresmesh)
geo_insolationhours_2 = RemoteReceiver(geo_insolationhours)
geo_cuttedvolumes_2 = RemoteReceiver(geo_cuttedvolumes)
geo_coloredmeshes_2 = RemoteReceiver(geo_coloredmeshes)
geo_compasscrvs_2 = RemoteReceiver(geo_compasscrvs)
geo_pathcrvs_2 = RemoteReceiver(geo_pathcrvs)
geo_sunrays_2 = RemoteReceiver(geo_sunrays)
geo_sunrays_3 = RemoteReceiver(geo_sunrays)
geometry_15 = RemoteReceiver(geometry_5)
context_7 = RemoteReceiver(context_5)

# ---- group: PreviewOn/Off
time_12 = ConstructTime(Hour=0, Minute=geo_insolationhours_2, Second=0)
coloredmeshes_3 = ColoredMeshes(geo_coloredmeshes_2)
ddate_2 = DeconstructDate(Date=time_12)  # -> Year, Month, Day, Hour, Minute, Second
data_66 = Data(geo_sunrays_3)
expression_5 = Expression(x=ddate_2.Minute, Expression="Format(\"{0:00}\",x)")
expression_6 = Expression(x=ddate_2.Hour, Expression="Format(\"{0:00}\",x)")
facen_2 = FaceNormals(Mesh=coloredmeshes_3)  # -> Centers, expr("x*0.1", Normals)
# PreviewBlock
geometry_16 = Data(geometry_15)
context_8 = Data(context_7)
rays_3 = Data(geo_sunrays_2)
cuttedvolumes_2 = Data(geo_cuttedvolumes_2)
cp_3 = ControlPoints(Curve=data_66)  # -> Points, Weights, Knots
move_5 = Move(Geometry=coloredmeshes_3, Motion=facen_2.Normals)  # -> Geometry, Transform
volume = Volume(Geometry=cuttedvolumes_2)  # -> Volume, Centroid
pline = PolyLine(Vertices=cp_3.Points, Closed=True)
concat_3 = Concatenate(FragmentA=expression_6, FragmentB=":", FragmentC=expression_5)
scale = Scale(Geometry=cuttedvolumes_2, Center=volume.Centroid, Factor=Slider(0.999, range=0..1))  # -> Geometry, Transform
pcen = PolygonCenter(Polyline=pline)  # -> CenterV, CenterE, CenterA
mjoin_3 = MeshJoin(Meshes=flatten(move_5.Geometry))
swatch = ColourSwatch(SwatchColor=RGBA(255, 247, 0, 125))
data_67 = Data(graft(concat_3))
data_68 = Data(pcen.CenterV)
preview = CustomPreview(Geometry=geometry_16, Material=material)
preview_2 = CustomPreview(Geometry=context_8, Material=ColourSwatch(SwatchColor=RGBA(191, 191, 191, 100)))
preview_3 = CustomPreview(Geometry=scale.Geometry, Material=ColourSwatch(SwatchColor=RGBA(184, 51, 51, 100)))
textbaker = TextBaker(
    Location=data_68,
    Text=data_67,
    Size=Slider(4.257, range=0..10),
    Color=ColourSwatch(SwatchColor=RGB(255, 255, 255)),
    Justification=9,
    Activate=Toggle(False))
data_69 = Data(geo_sunspheresmesh_2)
data_70 = Data(geo_pathcrvs_2)
data_71 = Data(geo_compasscrvs_2)

# ----
coloredmeshes_4 = ColoredMeshes(geo_coloredmeshes_python_2)
facen_3 = FaceNormals(Mesh=coloredmeshes_4)  # -> Centers, expr("x*0.1", Normals)
move_6 = Move(Geometry=coloredmeshes_4, Motion=facen_3.Normals)  # -> Geometry, Transform
mjoin_4 = MeshJoin(Meshes=flatten(move_6.Geometry))
preview_4 = CustomPreview(Geometry=rays_3, Material=swatch)
coloredmeshes_5 = Data(mjoin_3)
mesh_10 = Mesh(mjoin_4)

# ---- group: Chart
data_72 = Data(graft(def_domain_interrupted_2))
data_73 = Data(graft(def_domain_uninterrupted_2))
item_22 = ListItem(List=def_colour_interrupted_2, Index=0, Wrap=True)
item_23 = ListItem(List=def_colour_uninterrupted_2, Index=0, Wrap=True)
shift_39 = ShiftPaths(Data=data_72, Offset=2)
shift_40 = ShiftPaths(Data=data_73, Offset=2)
data_74 = Data(item_22)
data_75 = Data(item_23)
int_13 = Integer("0")
chart = CreateChart(Data=int_13, Names="0", Title="Percentage of panels", SubTitle=panel_10, ChartType=1)
multichart = CreateMultiChart(Data=int_13, Title="Percentage of panels", SubTitle=panel_10, ChartType=1)
chatr = Data(chart)
adjustelem_10 = AdjustElementAppearance(ElementsToAdjust=chatr, FontSize=Slider(15, range=0..20))
tooltip_8 = AttachTooltipToElement(ElementsToAttachTo=chatr, TooltipContent=panel_9, ShowDelay=500, Duration=10000)
adjustpos_23 = AdjustElementPositioning(
    ElementsToAdjust=chatr,
    AbsolutePositioning=False,
    Width=Slider(425, range=0..1000),
    Height=Slider(481, range=0..1000),
    HorizontalAlignment=2,
    VerticalAlignment=3)

# ----
data_76 = Data(chatr)
data_77 = Data(data_76)
entwine_23 = Entwine(
    Branch00=label_percentage_time_2,
    Branch01=shapeui_2,
    Branch02=analysistoggle_3,
    Branch03=toggle_showlegend_2,
    Branch04=data_77,
    Branch05=gridoftoggles_2,
    FlattenInputs=True)
addelems_4 = AddElements(Window=windowresults_3, Elements=flatten(entwine_23), DoVLChecking=True)  # -> AddedElements, ElementNames

# ---- group: PercentageOfPanels(ForSelectedBuilding)
data_78 = Data(time_10)
dpath_4 = DeconstructPath(Branch=data_62)
item_24 = ListItem(List=dpath_4, Index=0, Wrap=True)
rep = ReplaceText(Text="{path;*}", Find="path", Replace=item_24, RecursiveReplace=False)
split_16 = SplitTree(Data=data_78, Masks=flatten(rep))  # -> Positive, Negative
null = NullItem(Item=split_16.Positive)  # -> NullFlags, InvalidFlags, Description
bool_4 = Boolean(invert(null.NullFlags))
cset_3 = CreateSet(List=flatten(bool_4))  # -> Set, Map
filter_4 = StreamFilter(Gate=cset_3.Set, Stream0=data_78, Stream1=split_16.Positive)
path_mapper_4 = PathMapper(filter_4, source="{A;B;C;D}", target="{C;D}")
data_79 = Data(path_mapper_4)
split_17 = SplitTree(Data=data_79, Masks=flatten("{2;*}"))  # -> Positive, Negative
shift_41 = ShiftPaths(Data=split_17.Positive, Offset=1)
shift_42 = ShiftPaths(Data=split_17.Negative, Offset=1)
lng_12 = ListLength(List=shift_41)
lng_13 = ListLength(List=shift_42)
merge_54 = Merge(Data1=flatten(lng_12), Data2=flatten(lng_13))
ma_4 = MassAddition(Input=merge_54)  # -> Result, PartialResults

# ----
expression_7 = Expression(x=lng_12, Expression="x*100")
expression_8 = Expression(x=lng_13, Expression="x*100")

# ---- group: PercentageOfPanels(ForSelectedBuilding) (continued)
division_9 = Division(A=expression_8, B=ma_4.Result)
division_10 = Division(A=expression_7, B=ma_4.Result)
expression_9 = Expression(x=division_10, Expression="Format(\"{0:0.00}\",x)")
expression_10 = Expression(x=division_9, Expression="Format(\"{0:0.00}\",x)")
num_2 = Number(expression_9)
num_3 = Number(expression_10)
clean_10 = CleanTree(RemoveNulls=True, RemoveInvalid=True, RemoveEmpty=True, Tree=num_2)
clean_11 = CleanTree(RemoveNulls=True, RemoveInvalid=True, RemoveEmpty=True, Tree=num_3)

# ----
uninterrupted = Data(clean_11)
interrupted = Data(clean_10)
def_dataforchart_uninterrupted = RemoteSender(uninterrupted)
def_dataforchart_uninterrupted_2 = RemoteReceiver(def_dataforchart_uninterrupted)
def_dataforchart_interrupted = RemoteSender(interrupted)
def_dataforchart_interrupted_2 = RemoteReceiver(def_dataforchart_interrupted)

# ---- group: Chart (continued)
data_80 = Data(def_dataforchart_interrupted_2)
data_81 = Data(def_dataforchart_uninterrupted_2)
tstat_14 = TreeStatistics(Tree=data_80)  # -> Paths, Length, Count
tstat_15 = TreeStatistics(Tree=data_81)  # -> Paths, Length, Count
split_18 = SplitTree(Data=data_80, Masks=flatten("{3}"))  # -> Positive, Negative
branch_5 = TreeBranch(Tree=data_74, Path=tstat_14.Paths, MaintainPaths=True)
branch_6 = TreeBranch(Tree=data_75, Path=tstat_15.Paths, MaintainPaths=True)
branch_7 = TreeBranch(Tree=shift_39, Path=tstat_14.Paths, MaintainPaths=True)
branch_8 = TreeBranch(Tree=shift_40, Path=tstat_15.Paths, MaintainPaths=True)
split_19 = SplitTree(Data=branch_5, Masks=flatten("{3}"))  # -> Positive, Negative
split_20 = SplitTree(Data=branch_7, Masks=flatten("{3}"))  # -> Positive, Negative
concat_4 = Concatenate(FragmentA=split_20.Negative, FragmentB=" Interrupted")

# ----
split_21 = SplitTree(Data=data_81, Masks=flatten("{3}"))  # -> Positive, Negative
data_82 = Data(flatten(split_21.Negative))
unflatten_2 = UnflattenTree(Tree=reverse(data_82), Guide=split_21.Negative)
split_22 = SplitTree(Data=branch_8, Masks=flatten("{3}"))  # -> Positive, Negative
data_83 = Data(flatten(split_22.Negative))
split_23 = SplitTree(Data=branch_6, Masks=flatten("{3}"))  # -> Positive, Negative
unflatten_3 = UnflattenTree(Tree=reverse(data_83), Guide=split_22.Negative)
data_84 = Data(flatten(split_23.Negative))
unflatten_4 = UnflattenTree(Tree=reverse(data_84), Guide=split_23.Negative)

# ---- group: Chart (continued)
addition_5 = Addition(A=split_18.Positive, B=split_21.Positive)
entwine_24 = Entwine(Branch00=addition_5, Branch01=unflatten_2, Branch02=split_18.Negative, FlattenInputs=True)
merge_55 = Merge(Data1=split_19.Positive, Data2=split_23.Positive)
merge_56 = Merge(Data1=split_20.Positive, Data2=split_22.Positive)
clean_12 = CleanTree(RemoveNulls=True, RemoveInvalid=True, RemoveEmpty=True, Tree=merge_55)  # -> flatten(Tree)
item_25 = ListItem(List=clean_12, Index=0, Wrap=True)
clean_13 = CleanTree(RemoveNulls=True, RemoveInvalid=True, RemoveEmpty=True, Tree=merge_56)  # -> flatten(Tree)
concat_5 = Concatenate(FragmentA=unflatten_3, FragmentB=" Direct")
item_26 = ListItem(List=clean_13, Index=0, Wrap=True)
entwine_25 = Entwine(Branch0X=item_25, Branch1X=unflatten_4, Branch2X=split_19.Negative, FlattenInputs=False)
replace_5 = ReplaceItems(List=item_26, Item="Full insolation", Indices=0, Wrap=False)  # -> flatten(List)
entwine_26 = Entwine(Branch00=replace_5, Branch01=concat_5, Branch02=concat_4, FlattenInputs=True)
data_85 = Data(flatten(entwine_25))
chartappearance = ChartAppearance(ChartToModify=chatr, Colors=data_85, Legend=False, Title=True)

# ----
clean_14 = CleanTree(RemoveNulls=True, RemoveInvalid=True, RemoveEmpty=True, Tree=entwine_24)
null_2 = NullItem(Item=entwine_24)  # -> NullFlags, InvalidFlags, Description
tstat_16 = TreeStatistics(Tree=entwine_26)  # -> Paths, Length, Count
cset_4 = CreateSet(List=null_2.NullFlags)  # -> Set, Map
dispatch_12 = Dispatch(List=tstat_16.Paths, DispatchPattern=flatten(cset_4.Set))  # -> ListA, ListB
split_24 = SplitTree(Data=entwine_26, Masks=flatten(dispatch_12.ListB))  # -> Positive, Negative

# ---- group: Chart (continued)
data_86 = Data(flatten(clean_14))
data_87 = Data(flatten(split_24.Positive))

# ----
data_88 = DataDescription(data_86)

# ---- group: Chart (continued)
setchart = SetChartContents(ChartToModify=chart, NewChartValues=data_88, NewChartNames=data_87)
setmultichart = SetMultiChartContents(ChartToModify=multichart, NewChartValues=flatten(data_88), NewChartNames=flatten(data_87), ClusterTitle="%")  # disabled
